# Grasshopper definition 00_froGH_Data.gh (Grasshopper 1.0.7)
# Copyright: Co-de-iT
# plug-ins: froGH

# froGH
number_slider = Slider(1, range=0..10)
series = Series(Start=0, Step=1, Count=10)
pt = Point(Point(34.21674009, 0, 0))
series_2 = Series(Start=0, Step=1, Count=10)
wrap = BooleanToggle(False)
series_3 = Series(Start=series, Step=1, Count=10)  # -> simplify(graft(Series))
series_4 = Series(Start=0, Step=1, Count=10)
series_5 = Series(Start=series_2, Step=1, Count=10)
charseq = CharSequence(Count=10, CharPool="ABCDEFGHIJKLMNOPQRSTUVWXYZ", Format="{0}")
cir = Circle(Plane=pt, Radius=Slider(3.306, range=1..5))
# For examples on the usage of create RTree see 02_froGH_Geometry.gh
f_crtree = CreateRTree()
f_dshift = DoubleShift(List=series_4, Wrap=wrap)  # -> ForwardShift, BackwardShift
f_dtg = DataTreeGraph(DataTree=series_5, InscriptionCircle=cir)  # -> Twigs, Leaves, Arcs, TwigsText, LeavesText
f_sdom = SymmetricDomain(DomainSemiextension=Slider(1, range=0..10))
f_sbpath = SerialBranchPath(Tree=series_3, BranchNumber=Slider(35, range=0..100))  # -> Path, Data
f_cdom = CenteredDomain(DomainLength=number_slider)
f_ifroml = IndexesFromList(Data=charseq)
f_ifromn = IndexesFromNumber(Amount=Slider(18, range=1..100))
panel = Panel(f_sdom)
panel_2 = Panel(f_ifromn)
panel_3 = Panel(f_ifroml)
panel_4 = Panel(f_cdom)
path = Panel(f_sbpath.Path)
data = Panel(f_sbpath.Data)
forward_shift = Panel(f_dshift.ForwardShift)
backward_shift = Panel(f_dshift.BackwardShift)
entwine = Entwine(Branch00=f_dtg.Twigs, Branch01=f_dtg.Leaves, Branch02=f_dtg.Arcs, FlattenInputs=True)
entwine_2 = Entwine(
    Branch00=ColourSwatch(SwatchColor=RGB(0, 0, 0)),
    Branch01=ColourSwatch(SwatchColor=RGB(181, 16, 16)),
    Branch02=ColourSwatch(SwatchColor=RGB(102, 102, 102)),
    FlattenInputs=True)
entwine_3 = Entwine(Branch00=f_dtg.Twigs, Branch01=f_dtg.Leaves, FlattenInputs=True)
entwine_4 = Entwine(Branch00=f_dtg.TwigsText, Branch01=f_dtg.LeavesText, FlattenInputs=True)
entwine_5 = Entwine(Branch00=ColourSwatch(SwatchColor=RGB(0, 0, 0)), Branch01=ColourSwatch(SwatchColor=RGB(181, 16, 16)), FlattenInputs=True)
data_2 = Panel("""0
1
2
3
4""")
weigths = Panel("""3
15
8
70
4""")
# froGH - Data example file
# 
# Examples for the usage of froGH Data components
# 
# code by Alessio Erioli
# 
# v 0.1
# © Co-de-iT 2020 / Creative Commons Attribution-Non Commercial-ShareAlike 4.0 International License
panel_5 = Panel("""True
False
False""")
preview = CustomPreview(Geometry=entwine, Material=entwine_2)
curvepoint = PointOnCurve(entwine_3, parameter=0.75)
f_massbool = MassBoolean(Values=panel_5, BooleanOperator="AND", Boolean_Operator="AND")
f_wrc = WeightedRandomChoice(Data=data_2, Weights=weigths, NumberOfItems="1000", Seed="2")
tag = TextTag3D(Location=curvepoint, Text=entwine_4, Size=Slider(0.1, range=0..1), Colour=entwine_5, Justification=5)
panel_6 = Panel(f_massbool)
bar_graph = BarGraph(f_wrc, BarColor=RGB(255, 0, 90))
# reference objects from Rhino
geo = Geometry([<curve referenced from the Rhino model> x2])
# use GUID parameter component for every non-geometry object (dots, dimensions, blocks, text, etc.)
# dot
id = Guid(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)
# block
id_2 = Guid(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)
select = Button()
# input a block name from a Rhino file
panel_7 = Panel("sample block")
# reference an object from Rhino
geo_2 = Geometry(<curve referenced from the Rhino model>)
geo_3 = Geometry(<curve referenced from the Rhino model>)
# reference a dot from Rhino
# dot
id_3 = Guid(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)
merge = Merge(Data1=geo, Data2=id, Data3=id_2)
f_dotdecon = DeconstructDot(TextDot=id_3)  # -> Location, MainText, SecondaryText, TextSize, TextFont
f_bldecon = DeconstructBlockFromID(BlockID=panel_7)
f_olay = ObjectLayer(Object=geo_2)
f_selrhobj = SelectRhinoObjects(Objects=merge, SelectionTrigger=select)
panel_8 = Panel(f_bldecon)
panel_9 = Panel(f_dotdecon.MainText)
panel_10 = Panel(f_olay)
panel_11 = Panel(f_dotdecon.Location)
panel_12 = Panel(f_dotdecon.SecondaryText)
panel_13 = Panel(f_selrhobj)
panel_14 = Panel(f_dotdecon.TextSize)
panel_15 = Panel(f_dotdecon.TextFont)
go = BooleanToggle(False)
reset = Button()
c_script = CSharpScript(go=go, reset=reset)  # -> C; inputs go: Boolean, reset: Boolean
# ---------- c_script: C# ----------
    if(reset) count = 0;
    if(go) 
    {
      count++;
      Component.ExpireSolution(true);
    }
    C = count;
# ---------- c_script: C# additional code ----------
  int count;
# ---------- end c_script ----------
panel_16 = Panel(c_script)
larger = LargerThan(FirstNumber=c_script, SecondNumber="20")  # -> LargerThan, OrEqualTo
f_fro = Froggle(Button=Button())
f_tas = ToggleAutostop(Toggle=go, Condition=larger.OrEqualTo)
panel_17 = Panel(f_fro)
number_slider_2 = Slider(100, range=10..100)
pop3d = Populate3D(Region={Plane=PlaneXY(0, 0, 0), X=Domain(0, 10), Y=Domain(0, 10), Z=Domain(0, 2)}, Count=number_slider_2, Seed=1)
random = Random(Range=Domain(0, 1), Number=number_slider_2, Seed=2)
wheel = ColourWheel(
    number_slider_2,
    ColourGrips_Style=10,
    ColourGrips_Grip=[5.484274453, 2.094395102, 4.188790205, 3.141592654],
    ColourGrips_Lum=[0.1, 0.5],
    ColourGrips_Range=[0.2617993878, 0.2617993878, 0.2617993878, 0.2617993878],
    ColourGrips_Sat=[0.2, 0.6])
msphere = MeshSphere(Base=pop3d, Radius=random, UCount=10, VCount=20)
preview_2 = CustomPreview(Geometry=msphere, Material=wheel)
group = BooleanToggle(False)
bake = Button()
f_bake = BakeAttributesEnhanced(Objects=msphere, LayerName="spheres", Color=wheel, BakeInGroups=group, Bake=bake)
