# Grasshopper definition 02_froGH-Human_Geometry.gh (Grasshopper 1.0.7)
# plug-ins: froGH, MeshEdit Components, Human

# Human
number_slider = Slider(1, range=0..20)
# Trilateration at work: rigid panel movement calculation
movement = Slider(0.001, range=0.001..0.999)
radius = Slider(10, range=1..50)
# froGH
number_slider_2 = Slider(2, range=0..20)

# ---- group: Search point - Box
pt = Point(Point(6.995380842, 3.084801497, 0.9987402664))

# ----
number_slider_3 = Slider(0.85, range=0..10)
pt_2 = Point([Point(5.840536955, 87.42759567, 4.386624388), Point(18.82432692, 81.88102559, 0), Point(13.72861816, 74.33915316, 2.335433056)])
Z = UnitZ(Factor=1)
X = UnitX(Factor=1)

# ---- group: 20000 points
pt_3 = Point([Point(2.486685842, 1.107439772, 0.9340213597), Point(8.75821514, 7.961442879, 0.4404517982), Point(0.960044973, 9.516898365, 0.9651758973), Point(9.142282707, 0.9184793154, 1.504984329), Point(4.419897676, 6.225770733, 1.422511779), Point(9.71759215, 4.613409189, 1.807313576)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])

# ----
box = CenterBox(Base=pt, X=number_slider, Y=Slider(2, range=0..20), Z=Slider(1, range=0..20))

# ---- group: search point - Sphere
pt_4 = Point(Point(2.767547287, 6.794101691, 0))

# ----
Y = UnitY(Factor="15")
start_point_index = Panel("100")
rec = Rectangle({Plane=PlaneXY(6.110758068, 35.73683901, 0), Size=Domain2(u=-6.110758068..6.110758068, v=-5.736839013..5.736839013)})
merge = Merge(Data1=Slider(11.594, range=0..50), Data2=Slider(9.029, range=0..50), Data3=Slider(10.38, range=0..50))
sph = Sphere(Base=pt_2, Radius=merge)
multiplication = Multiplication(A=movement, B=radius)
pt_5 = Point(Point(19.42306934, 119.7384291, 0))
pi = Pi(Factor=Slider(1.323, range=0..2))
move = Move(Geometry=pt_3, Motion=Y)  # -> Geometry, Transform

# ---- group: static RTree
f_crtree = CreateRTree(SourceData=pt_3)
# froGH - Geometry example file
# 
# Examples for the usage of froGH Geometry components
# 
# code by Alessio Erioli
# 
# v 0.1
# © Co-de-iT 2020 / Creative Commons Attribution-Non Commercial-ShareAlike 4.0 International License
f_rtreecp = RTreeClosestPoint(SearchPoints=pt_4, RTree=f_crtree)  # -> ClosestPoint, ClosestPointsIndex
f_ptssphrt = PointsInSphereRTree(SphereCenter=pt_4, SearchRadius=number_slider_2, RTree=f_crtree)  # -> Points, PointsIndices

# ----
f_pcd = PointCloudDisplay(Points=pt_3, Colors=ColourSwatch(SwatchColor=RGB(121, 219, 218)), Size=1)
pop2d = Populate2D(Region=rec, Count=Slider(27, range=3..100), Seed=1)
item = ListItem(List=sph, Index=0, Wrap=True)  # -> Item, Item1, Item2
Z_2 = UnitZ(Factor=multiplication)
X_2 = UnitX(Factor=1)
expression = Expression(x=radius, Expression="-x*1.1")
Y_2 = UnitY(Factor=1)
xy = XYPlane(Origin=Point(0, 0, 0))
vrot = Rotate(Vector=X, Axis=Z, Angle=pi)
pt_6 = Point([Point(8.035001714, 54.97322096, 0), Point(8.170471351, 52.6431432, 0), Point(5.08176363, 56.84270195, 0), Point(10.44636125, 57.70970762, 0), Point(3.049719077, 54.89193918, 0), Point(5.108857558, 51.31554076, 0), Point(7.736968513, 51.07169542, 0), Point(2.236901256, 51.69485575, 0), Point(4.350227591, 49.28349621, 0), Point(7.222183893, 48.79580552, 0), Point(11.17789729, 53.23920961, 0), Point(11.15080336, 54.48553027, 0), Point(6.300990362, 58.90184043, 0), Point(5.325608977, 60.28363072, 0), Point(2.832967658, 55.84022664, 0), Point(5.759111815, 52.39929786, 0), Point(1.261519871, 54.89193918, 0), Point(1.207332016, 58.22449224, 0), Point(2.426558748, 58.33286795, 0)])
move_2 = Move(Geometry=pt_5, Motion=Z_2)  # -> Geometry, Transform
f_trilat = Trilateration(Sphere1=item.Item, Sphere2=item.Item1, Sphere3=item.Item2)  # -> PointA, PointB

# ---- group: Clusterize by distance
f_ptscbd = ClusterizePointsByDistance(Points=move.Geometry, Index=start_point_index, ClusterizationDistance=number_slider_3)  # -> ClusteredPoints, ClusteredIndices

# ----
f_svang = SignedVectorAngle(Vector1=X, Vector2=vrot, ZAxis=Vector(0, 0, 1))

# ---- group: dynamic RTree
f_ptssph = PointsInSphere(SphereCenter=pt_4, CloudToSearch=pt_3, SearchRadius=number_slider_2)  # -> Points, PointsIndices
f_ptsaabb = PointsInAABB(BoundingBox=box, CloudToSearch=pt_3)  # -> Points, PointsIndices

# ----
f_sec = SmallestEnclosingCircle(Points=pop2d, ReferencePlane=PlaneXY(0, 0, 0))
f_ptsbyang = SortPointsByAngle(Points=pt_6, ReferencePlane=xy)  # -> Points, Indexes, Angles
f_ptsaabbrt = PointsInAABBRTree(BoundingBox=box, RTree=f_crtree)  # -> Points, PointsIndices
points = PointList(Points=pt_6, Size=Slider(1, range=0..2))
line = LineSDL(Start=pt_5, Direction=Y_2, Length=expression)
sph_2 = Sphere(Base=move_2.Geometry, Radius=radius)
line_2 = LineSDL(Start=pt_5, Direction=X_2, Length=expression)
sqrt = SquareRoot(Value="2")
pline = PolyLine(Vertices=f_ptsbyang.Points, Closed=False)
panel = Panel(f_svang)
avr = Average(Input=f_ptscbd.ClusteredPoints)
preview = CustomPreview(
    Geometry=f_rtreecp.ClosestPoint,
    Material={diffuse=RGB(221, 160, 221), emission=RGB(66, 48, 66), shine=0.5, specular=RGB(255, 255, 255), transparency=0})
bcx = BrepCurve(Brep=sph_2, Curve=line_2)  # -> Curves, Points
bcx_2 = BrepCurve(Brep=sph_2, Curve=line)  # -> Curves, Points
multiplication_2 = Multiplication(A=radius, B=sqrt)
preview_2 = CustomPreview(Geometry=f_sec, Material=ColourSwatch(SwatchColor=RGB(255, 0, 0)))
preview_3 = CustomPreview(Geometry=pline, Material=ColourSwatch(SwatchColor=RGB(0, 0, 0)))
dots = DotDisplay(Point=pop2d, Colour=RGB(0, 0, 0), Size="0.2")
dots_2 = DotDisplay(Point=pt_6, Colour=RGB(0, 0, 0), Size="0.2")
# on RTrees: An RTree is a spatial search structure to speed neighbour search in space.
# 
# static RTree performs best when the points to search do not change over time - RTree is generated once in the create RTree component and it can be searched at will
# 
# 
# dynamic RTree recomputes an RTree at each iteration, making it suitable for cases of dynamic points to search (i.e. agents positions in a moving flock)
f_pcd_2 = PointCloudDisplay(Points=f_ptssphrt.Points, Size="3")
f_pcd_3 = PointCloudDisplay(Points=f_ptsaabbrt.Points, Colors=ColourSwatch(SwatchColor=RGB(255, 119, 0)), Size="3")
dots_3 = DotDisplay(Point=[f_trilat.PointA, f_trilat.PointB], Colour=ColourSwatch(SwatchColor=RGB(0, 255, 255)), Size="0.5")
msphere = MeshSphere(Base=avr, Radius=number_slider_3, UCount=10, VCount=20)
tstat = TreeStatistics(Tree=f_ptscbd.ClusteredPoints)  # -> Paths, Length, Count
ln = Line(StartPoint=f_ptscbd.ClusteredPoints, EndPoint=avr)
sph_3 = Sphere(Base=move_2.Geometry, Radius=multiplication_2)
sph_4 = Sphere(Base=bcx.Points, Radius=radius)
sph_5 = Sphere(Base=bcx_2.Points, Radius=radius)
range = Range(Domain=Domain(0, 1), Steps=tstat.Count)
gradient = Gradient(
    LowerLimit=0,
    UpperLimit=1,
    Parameter=range,
    stops=[0: RGB(21, 0, 33), 0.326: RGB(150, 66, 114), 0.664: RGB(224, 186, 187), 1: RGB(255, 255, 255)])
f_trilat_2 = Trilateration(Sphere1=sph_3, Sphere2=sph_4, Sphere3=sph_5)  # -> PointA, PointB

# ---- group: display spheres that would intersect
merge_2 = Merge(Data1=flatten(sph_3), Data2=flatten(sph_4), Data3=flatten(sph_5))
preview_4 = CustomPreview(Geometry=merge_2, Material=ColourSwatch(SwatchColor=RGBA(16, 0, 51, 32)))

# ----
alpha = Slider(0.85, range=0..1)
cull_i = CullIndex(List=gradient, Indices="-1", Wrap=True)
pt_7 = Point(f_trilat_2.PointA)
pt_8 = ConstructPoint(
    XCoordinate=Slider(-1.336, range=-10..10),
    YCoordinate=Slider(-0.209, range=-10..10),
    ZCoordinate=Slider(1.587, range=-10..10))
vec = VectorXYZ(
    XComponent=Slider(5.176, range=-10..10),
    YComponent=Slider(3.341, range=-10..10),
    ZComponent=Slider(-6.515, range=-10..10))  # -> Vector, Length
pl = PlaneNormal(Origin=pt_8, ZAxis=vec.Vector)
merge_3 = Merge(Data1=move_2.Geometry, Data2=bcx.Points, Data3=pt_7)
merge_4 = Merge(Data1=move_2.Geometry, Data2=pt_7, Data3=bcx_2.Points)

# ---- group: change color alpha
c_script = CSharpScript(C=cull_i, a=alpha)  # -> Ct; inputs C: Color, a: Double
# ---------- c_script: C# usings ----------
using System.Drawing;
# ---------- c_script: C# ----------
    Ct = Color.FromArgb((int) (255 * (1-a)), C);
# ---------- end c_script ----------

# ----
dots_4 = DotDisplay(Point=pt_7, Colour=RGB(0, 0, 0), Size="0.2")
orient = Orient(Source=pl, Target=PlaneXY(0, 0, 0))  # -> Geometry, Transform
crv = Curve(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)
preview_5 = CustomPreview(Geometry=f_ptscbd.ClusteredPoints, Material=graft(cull_i))
preview_6 = CustomPreview(Geometry=ln, Material=graft(cull_i))
preview_7 = CustomPreview(Geometry=msphere, Material=graft(c_script))
entwine = Entwine(Branch00=merge_3, Branch01=merge_4, FlattenInputs=True)
transform = Transform(orient.Transform)
divide = DivideCurve(Curve=crv, Count=Slider(100, range=10..100), Kinks=False)  # -> Points, Tangents, Parameters
matrix = TransformMatrix(transform, Digits=3)
conmesh = ConstructMesh(Vertices=entwine, Faces="T{0;1;2}")
pline_2 = PolyLine(Vertices=divide.Points, Closed=False)

f_euzyx = GetEulerAnglesZYX(Transform=transform)  # -> ZAngle, YAngle, XAngle
f_euzyz = GetEulerAnglesZYZ(Transform=transform)  # -> E1_Z, E2_Y, E3_Z

medges = MeshEdges(Mesh=conmesh)  # -> NakedEdges, InteriorEdges, NonManifoldEdges
preview_8 = CustomPreview(Geometry=conmesh, Material=ColourSwatch(SwatchColor=RGB(255, 255, 255)))
crv_2 = Curve(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)
f_fsframe = FrenetSerretFrame(Polyline=pline_2)  # -> Tangents, Normals, Binormal
# Transform   ->   Euler angles   ->   Transform
merge_5 = Merge(Data1=f_euzyx.ZAngle, Data2=f_euzyx.YAngle, Data3=f_euzyx.XAngle)
merge_6 = Merge(Data1=f_euzyz.E1_Z, Data2=f_euzyz.E2_Y, Data3=f_euzyz.E3_Z)
area = MeshArea(Mesh=conmesh)  # -> Area, Centroid
f_plp = PlaneFromLPolyline(Polyline=crv_2)
vdisex = VectorDisplayEx(Point=divide.Points, Vector=f_fsframe.Tangents, Colour=RGB(0, 0, 0), Width=2)
vdisex_2 = VectorDisplayEx(Point=divide.Points, Vector=f_fsframe.Normals, Colour=ColourSwatch(SwatchColor=RGB(155, 245, 0)), Width=2)
vdisex_3 = VectorDisplayEx(Point=divide.Points, Vector=f_fsframe.Binormal, Colour=ColourSwatch(SwatchColor=RGB(245, 0, 0)), Width=2)
areas_should_remain_constant = Panel(area.Area)
panel_2 = Panel(merge_5)
panel_3 = Panel(merge_6)

f_rotzyx = RotationFromZYXEulerAngles(ZAngle=f_euzyx.ZAngle, YAngle=f_euzyx.YAngle, XAngle=f_euzyx.XAngle)
f_rotzyz = RotationFromZYZEulerAngles(E1_Z=f_euzyz.E1_Z, E2_Y=f_euzyz.E2_Y, E3_Z=f_euzyz.E3_Z)

matrix_2 = TransformMatrix(f_rotzyz, Digits=3)
matrix_3 = TransformMatrix(f_rotzyx, Digits=3)
crv_3 = Curve(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)
pcen = PolygonCenter(Polyline=crv_3)  # -> CenterV, CenterE, CenterA
yz = YZPlane(Origin=pcen.CenterV)
mirror = Mirror(Geometry=crv_3, Plane=yz)  # -> Geometry, Transform
crv_4 = Curve(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)
crv_5 = Curve(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)
ccw = ColourSwatch(SwatchColor=RGB(255, 0, 0))
cw = ColourSwatch(SwatchColor=RGB(0, 153, 255))
merge_7 = Merge(Data1=crv_3, Data2=mirror.Geometry)
explode = Explode(Curve=merge_7, Recursive=True)  # -> Segments, Vertices
mesh = Mesh(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)
cull_i_2 = CullIndex(List=explode.Vertices, Indices="-1", Wrap=True)
vec_2 = Vector(explode.Segments)
f_plcw = IsPolylineClockwise(Polyline=merge_7)
f_flap = Flapper(Mesh=mesh, TaperingAngle=Slider(1.1, range=0..1.5), OffsetDistance=Slider(0.889, range=0..3))  # -> FoldInnerEdges, FoldOuterEdges, CutLines
f_adflt = AdaptiveFillet(Polyline=crv_4, FilletRatio=Slider(0.238, range=0..1), AngleDependent=Toggle(True))  # -> FilletedPolyline, Arcs, Lines
f_divtanang = DivideCurveByTangentAngle(Curve=crv_5, Increment=Slider(0.012, range=0..1), Threshold=Slider(0.103, range=0..3))  # -> Points, Tangents, TParameters
weave = Weave(Pattern=f_plcw, Stream0=ccw, Stream1=cw, NullGaps=False)
panel_4 = Panel(f_plcw)
vdisex_4 = VectorDisplayEx(Point=cull_i_2, Vector=vec_2, Colour=graft(weave), Width=3)
preview_9 = CustomPreview(Geometry=merge_7, Material=weave)
inner = ColourSwatch(SwatchColor=RGB(0, 0, 0))
cut_lines = ColourSwatch(SwatchColor=RGB(255, 0, 0))
outer = ColourSwatch(SwatchColor=RGB(255, 255, 255))
crv_6 = Curve(f_adflt.FilletedPolyline)
preview_10 = CustomPreview(Geometry=f_adflt.Arcs, Material=ColourSwatch(SwatchColor=RGB(255, 0, 0)))
preview_11 = CustomPreview(Geometry=f_adflt.Lines, Material=ColourSwatch(SwatchColor=RGB(0, 0, 0)))
preview_12 = CustomPreview(Geometry=f_flap.FoldInnerEdges, Material=inner)
preview_13 = CustomPreview(Geometry=f_flap.FoldOuterEdges, Material=outer)
preview_14 = CustomPreview(Geometry=f_flap.CutLines, Material=cut_lines)
srf = Surface(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)
crv_7 = Curve(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)
srf_2 = Surface(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)
project = Project(Curve=crv_7, Brep=srf, Direction=Vector(0, 0, 1))
f_sqtreec = SurfaceQuadTreeByCurve(Surface=srf, Curves=project, Iterations=Slider(5, range=1..5))
f_sqtreek = SurfaceQuadTreeByCurvature(Surface=srf_2, Threshold=Slider(0.05, range=0.05..1))
area_2 = Area(Geometry=f_sqtreek)  # -> Area, Centroid
area_3 = Area(Geometry=f_sqtreec)  # -> Area, Centroid
sqrt_2 = SquareRoot(Value=area_2.Area)
sqrt_3 = SquareRoot(Value=area_3.Area)
bnd = Bounds(Numbers=sqrt_2)
bnd_2 = Bounds(Numbers=sqrt_3)
dedomain = DeconstructDomain(Domain=bnd)  # -> Start, End
dedomain_2 = DeconstructDomain(Domain=bnd_2)  # -> Start, End
gradient_2 = Gradient(
    LowerLimit=dedomain.Start,
    UpperLimit=dedomain.End,
    Parameter=sqrt_2,
    stops=[0: RGB(0, 0, 0), 0.254: RGB(56, 136, 150), 0.765: RGB(186, 224, 224), 1: RGB(255, 255, 255)])
gradient_3 = Gradient(
    LowerLimit=dedomain_2.Start,
    UpperLimit=dedomain_2.End,
    Parameter=sqrt_3,
    stops=[0: RGB(0, 98, 0), 0.25: RGB(81, 175, 17), 0.5: RGB(159, 198, 146), 0.75: RGB(170, 235, 41), 1: RGB(221, 255, 53)])
preview_15 = CustomPreview(Geometry=f_sqtreek, Material=gradient_2)
preview_16 = CustomPreview(Geometry=f_sqtreec, Material=gradient_3)
justification = ValueList({"top left": 0, "middle left": 1, "bottom left": 2, "top center": 3, "middle center": 4, "bottom center": 5, "top right": 6, "middle right": 7, "bottom right": 8}, selected="middle center")
fonts = FontTable()
item_2 = ListItem(List=fonts, Index="84", Wrap=True)
panel_5 = Panel(fonts)
pt_9 = Point(Point(159.6522486, 24.68071175, 0))
panel_6 = Panel(item_2)
panel_7 = Panel("""hi
there
howdy""")
closed = BooleanToggle(False)
xy_2 = XYPlane(Origin=pt_9)
f_t2geom = TextToGeometry(
    TextString=panel_7,
    FontFace=panel_6,
    Closed=closed,
    Size=Slider(5, range=1..10),
    SamplingPrecision="250",
    BasePlane=xy_2,
    Justification=justification,
    TextOutputType="Polylines")
preview_17 = CustomPreview(Geometry=f_t2geom, Material=ColourSwatch(SwatchColor=RGB(29, 153, 153)))
panel_8 = Panel(f_t2geom)
number_slider_4 = Slider(100, range=10..5000)
random = Random(Range="0 to 5", Number=number_slider_4, Seed="1", Integers=True)
random_2 = Random(Range="0.5 to 2.5", Number=number_slider_4, Seed=2, Integers=False)
f_sphgen = SpaceFillingPolyhedraGenerator(BasePlane=PlaneXY(0, 0, 0), PolyhedronType=random, Scale=random_2)  # -> Mesh, FacePolylines
group = Group(Objects=f_sphgen.FacePolylines)  # -> flatten(Group)
merge_8 = Merge(Data1=simplify(graft(f_sphgen.Mesh)), Data2=simplify(graft(group)))
bbox = BoundingBox(Content=f_sphgen.Mesh, Plane=PlaneXY(0, 0, 0))  # -> Box, Box_2
group_2 = Group(Objects=merge_8)  # -> flatten(Group)
volume = Volume(Geometry=bbox.Box)  # -> Volume, Centroid
sort = SortList(Keys=volume.Volume, ValuesA=group_2)  # -> Keys, reverse(ValuesA)
pt_10 = Point(Point(179.3593452, 19.43907022, 0))
f_ifroml = IndexesFromList(Data=group_2)
rows_first = BooleanToggle(False)
lng = ListLength(List=group_2)
xz = XZPlane(Origin=pt_10)
gradient_4 = Gradient(LowerLimit=0, UpperLimit=lng, Parameter=f_ifroml, stops=[0: RGB(0, 255, 255), 1: RGB(255, 0, 255)])
f_orientgrid = OrientOnGrid(
    Geometry=sort.ValuesA,
    BasePlane=xz,
    PrimaryDimensionItems=Slider(10, range=5..50),
    XScale=Slider(1, range=1..3),
    YScale=Slider(1, range=1..3),
    RowFirst=rows_first)  # -> OrientedGeometry, BasePlanes, CellSize
ungroup = Ungroup(Group=f_orientgrid.OrientedGeometry)
devec = DeconstructVector(Vector=f_orientgrid.CellSize)  # -> XComponent, YComponent, ZComponent
offset = Slider(10, range=1..20)
f_cdom = CenteredDomain(DomainLength=devec.XComponent)
f_cdom_2 = CenteredDomain(DomainLength=devec.YComponent)
item_3 = ListItem(List=ungroup, Index=0, Wrap=True)  # -> Item, Item1
deplane = DeconstructPlane(Plane=f_orientgrid.BasePlanes)  # -> Origin, XAxis, YAxis, ZAxis
rectangle = Rectangle(Plane=f_orientgrid.BasePlanes, XSize=f_cdom, YSize=f_cdom_2, Radius=0)  # -> Rectangle, Length
multiplication_3 = Multiplication(A=deplane.ZAxis, B=offset)
move_3 = Move(Geometry=deplane.Origin, Motion=multiplication_3)  # -> Geometry, Transform
ungroup_2 = Ungroup(Group=item_3.Item1)
ln_2 = Line(StartPoint=deplane.Origin, EndPoint=move_3.Geometry)
preview_18 = CustomPreview(Geometry=item_3.Item, Material=graft(gradient_4))
previewlw = CustomPreviewLineweights(Geometry=ungroup_2, Shader=ColourSwatch(SwatchColor=RGB(0, 0, 0)), Absolute=False)
previewlw_2 = CustomPreviewLineweights(Geometry=ln_2, Shader=ColourSwatch(SwatchColor=RGB(128, 115, 52)), Absolute=False)
previewlw_3 = CustomPreviewLineweights(Geometry=rectangle.Rectangle, Shader=ColourSwatch(SwatchColor=RGB(135, 135, 135)), Absolute=False)
points_2 = PointList(Points=move_3.Geometry, Size=Slider(1, range=0.1..5))
