# Grasshopper definition 04_froGH_Mesh-Create.gh (Grasshopper 1.0.7)
# plug-ins: froGH

direction_type = ValueList({"Average of Face Normals": 0, "Angle weighted average of Face Normals": 1, "Angle + area weighted average of Face Normals": 2}, selected="Angle weighted average of Face Normals")
pt = Point(Point(35, 0, 0))
# froGH
polyhedron_type = ValueList({"Bisymmetric Hendecahedron": 0, "Rhombic Dodecahedron": 1, "Elongated Dodecahedron": 2, "Sphenoid Hendecahedron": 3, "Truncated Octahedron": 4, "Gyrobifastigium": 5}, selected="Bisymmetric Hendecahedron")
cir = Circle(Plane=pt, Radius=Slider(10, range=1..10))
pt_2 = Point([Point(116.2717046, -10.35837459, 1.578684969), Point(122.4318108, 20.34016112, -15.38516293), Point(114.1335338, -12.80605322, 32.51946676), Point(94.84208145, 12.82307025, 26.4523536), Point(95.00438057, 15.29545716, 3.712010207)])
mesh = Mesh(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)
divide = DivideCurve(Curve=cir, Count=Slider(50, range=5..50), Kinks=False)  # -> Points, Tangents, Parameters
nurbs = NurbsCurve(Vertices=pt_2, Degree=3, Periodic=False)  # -> Curve, Length, Domain
Y = UnitY(Factor="10")
distance_type = ValueList({"Face-Face at least": 0, "Face-Face at most": 1, "Face-Face average": 2, "Vertex-vertex constant": 3}, selected="Vertex-vertex constant")
medges = MeshEdges(Mesh=mesh)  # -> NakedEdges, InteriorEdges, NonManifoldEdges
pline = PolyLine(Vertices=divide.Points, Closed=Toggle(True))
offset_distance = Slider(-0.85, range=-1..1)
move = Move(Geometry=mesh, Motion=Y)  # -> Geometry, Transform
pframes = PerpFrames(Curve=nurbs.Curve, Count=Slider(42, range=10..100), Align=True)  # -> Frames, Parameters
explode = Explode(Curve=pline, Recursive=True)  # -> Segments, Vertices
justification = ValueList({"TopLeft": 0, "TopCenter": 1, "TopRight": 2, "MiddleLeft": 3, "MiddleCenter": 4, "MiddleRight": 5, "BottomLeft": 6, "BottomCenter": 7, "BottomRight": 8}, selected="BottomLeft")
medges_2 = MeshEdges(Mesh=move.Geometry)  # -> NakedEdges, InteriorEdges, NonManifoldEdges

# ---- group: Regular offset mesh
demesh = DeconstructMesh(Mesh=move.Geometry)  # -> Vertices, Faces, Colours, Normals
multiplication = Multiplication(A=demesh.Normals, B=offset_distance)
move_2 = Move(Geometry=demesh.Vertices, Motion=multiplication)  # -> Geometry, Transform
conmesh = ConstructMesh(Vertices=move_2.Geometry, Faces=demesh.Faces)

# ----
# froGH - Mesh-Create example file
# 
# Examples for the usage of froGH Mesh-Create components
# 
# code by Alessio Erioli
# 
# v 0.1
# © Co-de-iT 2020 / Creative Commons Attribution-Non Commercial-ShareAlike 4.0 International License
number_slider = Slider(15, range=1..100)
scale_nu = ScaleNU(Geometry=explode.Vertices, Plane=pt, ScaleX=Slider(0.5, range=0.001..1), ScaleY=Slider(1, range=0.001..1), ScaleZ=1)  # -> Geometry, Transform
preview = CustomPreview(Geometry=medges.InteriorEdges, Material=ColourSwatch(SwatchColor=RGB(0, 0, 0)))
yz = YZPlane(Origin=cir)
polygon = Polygon(Plane=pframes.Frames, Radius=Slider(1.5, range=1..2), Segments=Slider(6, range=3..10), FilletRadius=0)  # -> Polygon, Length
rotate = Rotate(Geometry=scale_nu.Geometry, Angle=Slider(1.571, range=0..1.571), Plane=yz)  # -> Geometry, Transform
preview_2 = CustomPreview(Geometry=medges_2.InteriorEdges, Material=ColourSwatch(SwatchColor=RGB(0, 0, 0)))
pt_3 = Point(Point(10.29679552, 0, 0))
f_meshoffex = MeshOffsetExtended(Mesh=mesh, OffsetDistance=offset_distance, DistanceType=distance_type, DirectionType=direction_type)  # -> Mesh, Normals
f_sphgen = SpaceFillingPolyhedraGenerator(BasePlane=PlaneXY(0, 0, 0), PolyhedronType=polyhedron_type, Scale=number_slider)  # -> Mesh, FacePolylines
f_t2geom = TextToGeometry(
    TextString="txt-smith",
    FontFace="Arial",
    Closed=True,
    Size="2",
    SamplingPrecision=50,
    BasePlane=pt_3,
    Justification=justification,
    TextOutputType="Polylines")
f_mbridge = MeshBridge(PonintsA=explode.Vertices, PonintsB=rotate.Geometry, Subdivisions=Slider(10, range=1..10))
f_pmloft = PolylinesMeshLoft(Polylines=polygon.Polygon, Closed=Toggle(False))
f_mrenorm = MeshRebuildNormals(Mesh=f_mbridge)
f_mrenorm_2 = MeshRebuildNormals(Mesh=f_pmloft)
demesh_2 = DeconstructMesh(Mesh=f_meshoffex.Mesh)  # -> Vertices, Faces, Colours, Normals
demesh_3 = DeconstructMesh(Mesh=conmesh)  # -> Vertices, Faces, Colours, Normals
f_fmesh = FastMeshFromPolyline(Polylines=f_t2geom)
mmx = MeshMesh(MeshA=move.Geometry, MeshB=conmesh)
preview_3 = CustomPreview(Geometry=f_mrenorm, Material=ColourSwatch(SwatchColor=RGB(255, 255, 255)))
medges_3 = MeshEdges(Mesh=f_mbridge)  # -> NakedEdges, InteriorEdges, NonManifoldEdges
medges_4 = MeshEdges(Mesh=f_pmloft)  # -> NakedEdges, InteriorEdges, NonManifoldEdges
crv = Curve(f_sphgen.FacePolylines)
preview_4 = CustomPreview(Geometry=f_sphgen.Mesh, Material=ColourSwatch(SwatchColor=RGB(255, 255, 255)))
preview_5 = CustomPreview(Geometry=f_mrenorm_2, Material=ColourSwatch(SwatchColor=RGB(255, 255, 255)))
f_mrenorm_3 = MeshRebuildNormals(Mesh=f_fmesh)
# check Front or Right parallel view in Rhino for this one
# Expected behavior (offset mesh is completely inside original)
vdisex = VectorDisplayEx(Point=demesh_2.Vertices, Vector=f_meshoffex.Normals, Colour=ColourSwatch(SwatchColor=RGB(255, 255, 255)), Width=2)
# intersection curve
preview_6 = CustomPreview(Geometry=mmx, Material=ColourSwatch(SwatchColor=RGB(255, 242, 0)))
# Weird behavior (Rhino default): face normal average produces weird vertex normals in fringe cases (like this triangular prism with sharp extremities) and offset mesh intersects the original!
vdisex_2 = VectorDisplayEx(Point=demesh_3.Vertices, Vector=demesh_3.Normals, Colour=ColourSwatch(SwatchColor=RGB(255, 0, 0)), Width=3)
preview_7 = CustomPreview(
    Geometry=f_mrenorm_3,
    Material={diffuse=RGB(221, 160, 221), emission=RGB(66, 48, 66), shine=0.5, specular=RGB(255, 255, 255), transparency=0})
