# Grasshopper definition 05-1_froGH_Topology-extended.gh (Grasshopper 1.0.7)
# plug-ins: froGH, Kangaroo2 Components

number_slider = Slider(50, range=1..100)
# froGH
number_slider_2 = Slider(4, range=1..6)
box = CenterBox(Base=PlaneXY(0, 0, 0), X=number_slider, Y=number_slider, Z=number_slider)
pop3d = Populate3D(Region=box, Count=Slider(200, range=10..10000), Seed=1)
prox = Proximity3D(Points=pop3d, Group=number_slider_2, MaxRadius=Slider(18.07, range=0..20))  # -> flatten(Links), Topology
dupln = RemoveDuplicateLines(Lines=prox.Links, Tolerance=0.01)
# froGH - Topology-extended example file
# 
# Extended example for the usage of froGH Topology components
# 
# code by Alessio Erioli
# 
# v 0.1
# © Co-de-iT 2020 / Creative Commons Attribution-Non Commercial-ShareAlike 4.0 International License
line = Line(flatten(dupln))
line_2 = Line(line)
f_tln = Topologizer(LinesNetwork=line_2, Decimals=3)  # -> Points, LinePointsData, Point2PointsConnectivity, LineDirectionAtEachPoint
# Convert Lines by Point into Point by Lines (or any other topological graph into its dual)
f_tinv = TopologyInverter(TopologyData=f_tln.LinePointsData)
f_tln_2 = Topologizer(LinesNetwork=line, Decimals=3)  # -> Points, LinePointsData, Point2PointsConnectivity, LineDirectionAtEachPoint
connections_direction = Panel(f_tln_2.LineDirectionAtEachPoint)
connections_endpoints = Panel(f_tln_2.LinePointsData)
nodes_connectivity = Panel(f_tln_2.Point2PointsConnectivity)
line_3 = Line(line_2)

# ---- group: P
pt = Point(f_tln.Points)

# ---- group: LP
int = Integer(f_tln.LinePointsData)

# ---- group: PP
int_2 = Integer(f_tln.Point2PointsConnectivity)

# ---- group: PL
int_3 = Integer(f_tinv)

# ---- group: LD
int_4 = Integer(f_tln.LineDirectionAtEachPoint)

# ---- group: highlight clusters
f_clstr = Clusterizer(TopologyData=f_tln_2.Point2PointsConnectivity)
f_tinv_2 = TopologyInverter(TopologyData=f_tln_2.LinePointsData)
item = ListItem(List=line, Index=f_tinv_2, Wrap=True)
tstat = TreeStatistics(Tree=f_clstr)  # -> Paths, Length, Count
group = Group(Objects=item)  # -> flatten(Group)
n_of_clusters = Panel(tstat.Count)
item_2 = ListItem(List=group, Index=f_clstr, Wrap=True)

# ----
connections_at_each_node = Panel(f_tinv_2)
panel = Panel(f_clstr)

# ---- group: display clusters
wheel = ColourWheel(
    tstat.Count,
    ColourGrips_Style=31,
    ColourGrips_Grip=[3.34820233, 5.442597433, 1.253807228, 0.2066096766],
    ColourGrips_Lum=[0.3788540866, 0.8454566554],
    ColourGrips_Range=[0.2980456393, 0.2980456393, 0.2980456393, 0.2980456393],
    ColourGrips_Sat=[0.1889716777, 0.7131070986])
lng = ListLength(List=f_tln_2.Point2PointsConnectivity)  # -> flatten(Length)
item_3 = ListItem(List=f_tln_2.Points, Index=f_clstr, Wrap=True)
item_4 = ListItem(List=lng, Index=f_clstr, Wrap=True)
multiplication = Multiplication(A=item_4, B=Slider(0.3, range=0..1))
preview = CustomPreview(Geometry=item_2, Material=graft(wheel))
dots = DotDisplay(Point=item_3, Colour=graft(wheel), Size=multiplication)

# ----
expression = Expression(x=int_4, Expression="int((x+1)*0.5)")
item_5 = ListItem(List=int, Index=0, Wrap=True)  # -> Item, Item1
curvepoint = PointOnCurve(line_3, parameter=0.5)
f_ifroml = IndexesFromList(Data=line_3)
f_ifroml_2 = IndexesFromList(Data=pt)
item_6 = ListItem(List=line_3, Index=int_3, Wrap=True)

# ---- group: display line network
preview_2 = CustomPreview(
    Geometry=line,
    Material={diffuse=RGB(221, 160, 221), emission=RGB(66, 48, 66), shine=0.5, specular=RGB(255, 255, 255), transparency=0})  # disabled

# ----
expression_2 = Expression(x=item_5.Item, y=item_5.Item1, Expression="Format(\"{0}-{1}\",int(x), int(y))")  # -> flatten(R)
int_5 = Integer(f_ifroml_2)
int_6 = Integer(f_ifroml)
vec = Vector(item_6)
arriving = ColourSwatch(SwatchColor=RGB(255, 0, 0))
departing = ColourSwatch(SwatchColor=RGB(255, 191, 0))
multiplication_2 = Multiplication(A=vec, B=int_4)
weave = Weave(Pattern=graft(expression), Stream0=arriving, Stream1=departing, NullGaps=False)
amp = Amplitude(Vector=multiplication_2, Amplitude=Slider(2, range=0..10))
pshift = ShiftPaths(Data=weave, Offset=-1)
lng_2 = ListLength(List=int_3)  # -> flatten(Length)
move = Move(Geometry=graft(pt), Motion=amp)  # -> Geometry, Transform
move_2 = Move(Geometry=graft(pt), Motion=amp)  # -> Geometry, Transform
unit = UnitVector(Vector=amp)
# connected lines vectors
vdisex = VectorDisplayEx(Point=graft(pt), Vector=unit, Colour=pshift, Width=3)
# lines tags
tag = TextTag3D(
    Location=curvepoint,
    Text=int_6,
    Size=Slider(1, range=0..5),
    Colour=ColourSwatch(SwatchColor=RGB(148, 117, 55)),
    Justification=2)
# point tags
tag_2 = TextTag3D(
    Location=pt,
    Text=int_5,
    Size=Slider(1, range=0..5),
    Colour=ColourSwatch(SwatchColor=RGB(255, 255, 255)),
    Justification=7)
# point valence
tag_3 = TextTag3D(
    Location=pt,
    Text=lng_2,
    Size=Slider(1, range=0..5),
    Colour=ColourSwatch(SwatchColor=RGB(135, 135, 135)),
    Justification=3)
# connection tags
tag_4 = TextTag3D(
    Location=curvepoint,
    Text=expression_2,
    Size=Slider(0.5, range=0..5),
    Colour=ColourSwatch(SwatchColor=RGB(8, 8, 8)),
    Justification=8)
# connected points tags
tag_5 = TextTag3D(
    Location=move_2.Geometry,
    Text=int_2,
    Size=Slider(0.3, range=0..5),
    Colour=ColourSwatch(SwatchColor=RGB(66, 161, 168)),
    Justification=8)
# connected lines tags
tag_6 = TextTag3D(Location=move.Geometry, Text=int_3, Size=Slider(0.2, range=0..5), Colour=pshift, Justification=2)
