# Grasshopper definition 05_froGH_Topology.gh (Grasshopper 1.0.7)
# plug-ins: Kangaroo2 Components, froGH

# froGH
pop3d = Populate3D(Region={Plane=PlaneXY(0, 0, 0), X=Domain(0, 10), Y=Domain(0, 10), Z=Domain(0, 2)}, Count=100, Seed=1)
prox = Proximity3D(Points=pop3d, Group=5, MaxRadius=Slider(1.42, range=0..10))  # -> flatten(Links), Topology
dupln = RemoveDuplicateLines(Lines=prox.Links, Tolerance=0.01)
f_tln = Topologizer(LinesNetwork=dupln, Decimals=3)  # -> Points, LinePointsData, Point2PointsConnectivity, LineDirectionAtEachPoint
nodes_indexes_sorted_by_connection = Panel(f_tln.LinePointsData)
neighbour_nodes_for_each_node = Panel(f_tln.Point2PointsConnectivity)
connection_directions_at_node_1_departin = Panel(f_tln.LineDirectionAtEachPoint)  # "connection directions at node (1 departing, -1 arriving)"

# ---- group: display node index
# froGH - Topology example file
# 
# Examples for the usage of froGH Topology components
# 
# code by Alessio Erioli
# 
# v 0.1
# © Co-de-iT 2020 / Creative Commons Attribution-Non Commercial-ShareAlike 4.0 International License
f_ifroml = IndexesFromList(Data=f_tln.Points)
tag = TextTag3D(Location=f_tln.Points, Text=f_ifroml, Size="0.1", Colour=ColourSwatch(SwatchColor=RGB(0, 0, 0)), Justification=1)

# ----
f_tinv = TopologyInverter(TopologyData=f_tln.LinePointsData)
f_clstr = Clusterizer(TopologyData=f_tln.Point2PointsConnectivity)
connection_indexes_sorted_by_node = Panel(f_tinv)
isolated_clusters_of_nodes = Panel(f_clstr)

# ---- group: groups of lines sorted by node
item = ListItem(List=dupln, Index=f_tinv, Wrap=True)
group = Group(Objects=item)  # -> flatten(Group)

# ----
item_2 = ListItem(List=group, Index=f_clstr, Wrap=True)
item_3 = ListItem(List=f_tln.Points, Index=f_clstr, Wrap=True)
tstat = TreeStatistics(Tree=f_clstr)  # -> Paths, Length, Count
n_of_clusters = Panel(tstat.Count)
wheel = ColourWheel(
    tstat.Count,
    ColourGrips_Style=10,
    ColourGrips_Grip=[5.370349682, 2.094395102, 4.188790205, 3.141592654],
    ColourGrips_Lum=[0.1, 0.5],
    ColourGrips_Range=[0.2617993878, 0.2617993878, 0.2617993878, 0.2617993878],
    ColourGrips_Sat=[0.2, 0.6])
preview = CustomPreview(Geometry=item_2, Material=graft(wheel))
preview_2 = CustomPreview(Geometry=item_3, Material=graft(wheel))
