# Grasshopper definition 06-1_froGH-Human_Camera Control Zoom + Save.gh (Grasshopper 1.0.7)
# Copyright: Co-de-iT
# plug-ins: Human, froGH

# froGH
# view data
# Human
viewsandmodes = NamedViewsAndDisplayModes(Update=True)  # -> NamedViews, DisplayModes
panel = Panel("""16
20
30
33
31""")
item = ListItem(List=viewsandmodes.DisplayModes, Index=panel, Wrap=True)
# 3
# Update the slider based based on Data Dam's delay
number_slider = Slider(0, range=0..4)
# froGH - View/Display example file
# 
# Examples for the usage of froGH View/Display components
# 
# code by Alessio Erioli
# 
# v 0.1
# © Co-de-iT 2020 / Creative Commons Attribution-Non Commercial-ShareAlike 4.0 International License
panel_2 = Panel("""Top
Perspective
Front
Right
myView""")
panel_3 = Panel("""1
0
1
1
2""")
panel_4 = Panel(item)
panel_5 = Panel("""-0.05
0.1
-0.1
-0.1
0.5""")

activate = Button()
# 1
f_fro = Froggle(Button=activate)

# ----
# serial
item_2 = ListItem(List=panel_2, Index=number_slider, Wrap=True)
item_3 = ListItem(List=panel_3, Index=number_slider, Wrap=True)
item_4 = ListItem(List=item, Index=number_slider, Wrap=True)
item_5 = ListItem(List=panel_5, Index=number_slider, Wrap=True)

activate_2 = Button()
# 1
f_fro_2 = Froggle(Button=activate_2)

panel_6 = Panel(item_4)
zoom = BooleanToggle(True)
zoom_2 = BooleanToggle(True)
# in parallel
geo = Geometry([<brep referenced from the Rhino model> x3])
f_camconz2geo = CameraControlAndZoomToGeometry(
    Geometry=geo,
    ViewportName=panel_2,
    CameraType=panel_3,
    DisplayMode=panel_4,
    ZoomFactor=panel_5,
    Zoom=zoom,
    Activate=f_fro)
f_camconz2geo_2 = CameraControlAndZoomToGeometry(
    Geometry=geo,
    ViewportName=item_2,
    CameraType=item_3,
    DisplayMode=item_4,
    ZoomFactor=item_5,
    Zoom=zoom_2,
    Activate=f_fro_2)
f_ghfilepath = GHFilePathInfo()  # -> FileName, FilePath

# ----
# Data Dam delay is set to 0.25 seconds, change this value according to your computer's performance (increase if saved image results incorrect)
dam = DataDam(DataA=f_camconz2geo_2, BufferDelay=2500000, BufferMode=2)

capture = Button()
# 2
f_fro_3 = Froggle(Button=capture)

capture_2 = Button()
# 2
f_fro_4 = Froggle(Button=capture_2)

panel_7 = Panel(f_camconz2geo)
concat = Concatenate(FragmentA=f_ghfilepath.FilePath, FragmentB="captures\")
f_vc2f = ViewCaptureToFile(
    FilePath=concat,
    FileName="image.png",
    ViewportName=f_camconz2geo,
    Scale="2",
    Grid=False,
    Axes=False,
    Widget=False,
    Capture=f_fro_3)
f_vc2f_2 = ViewCaptureToFile(
    FilePath=concat,
    FileName="image.png",
    ViewportName=dam,
    Scale="2",
    Grid=False,
    Axes=False,
    Widget=False,
    Capture=f_fro_4)
