# Grasshopper definition 06_froGH_View-Display.gh (Grasshopper 1.0.7)
# plug-ins: froGH, Weaverbird

# froGH
crv = Curve(reparameterize(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))

# ---- group: a simple rollercoaster
number_slider = Slider(25, range=10..100)
range = Range(Domain=Domain(0, 1), Steps=expr("x-1", number_slider))
pframes = PerpFrames(Curve=crv, Count=number_slider, Align=True)  # -> Frames, Parameters
graph = GraphMapper(range, x0=0, x1=1, y0=0, y1=1, container_name="Bezier", cpx=[0, 0.1734685451, 0.5223627687, 1], cpy=[1, 0, 0, 1])
multiplication = Multiplication(A=Slider(5.24, range=1..10), B=graph)
cir = Circle(Plane=pframes.Frames, Radius=multiplication)
gradient = Gradient(
    LowerLimit=0,
    UpperLimit=1,
    Parameter=range,
    stops=[0: RGB(243, 57, 0), 0.1: RGB(236, 27, 60), 0.2: RGB(210, 0, 118), 0.3: RGB(103, 0, 120), 0.4: RGB(39, 72, 161), 0.5: RGB(1, 192, 229), 0.6: RGB(18, 178, 90), 0.7: RGB(79, 186, 8), 0.8: RGB(220, 237, 32), 0.9: RGB(247, 159, 20), 1: RGB(243, 57, 0)])
pframes_2 = PerpFrames(Curve=cir, Count=Slider(20, range=5..20), Align=True)  # -> Frames, Parameters
polygon = Polygon(Plane=pframes_2.Frames, Radius=Slider(0.5, range=0..1), Segments=6, FilletRadius=0)  # -> Polygon, Length
f_pmloft = PolylinesMeshLoft(Polylines=polygon.Polygon, Closed=Toggle(True))  # -> flatten(Mesh)
preview = CustomPreview(Geometry=f_pmloft, Material=gradient)

# ----
# 1. activate the camera controller component
# 
# 2. change or animate this slider for a rollercoaster ride!
camera_position = Slider(0, range=0..1)
selector = Slider(0.263, range=0..1)
subdir_name = Panel("captures\")
pt = Point(Point(178.4813996, 0, 0))
f_ghfilepath = GHFilePathInfo()  # -> FileName, FilePath
cw = BooleanToggle(False)

activate = Button()
f_fro = Froggle(Button=activate)

# ----
# froGH - View/Display example file
# 
# Examples for the usage of froGH View/Display components
# 
# code by Alessio Erioli
# 
# v 0.1
# © Co-de-iT 2020 / Creative Commons Attribution-Non Commercial-ShareAlike 4.0 International License
eval = EvaluateCurve(Curve=crv, Parameter=camera_position)  # -> Point, Tangent, Angle
f_sphgen = SpaceFillingPolyhedraGenerator(BasePlane=pt, PolyhedronType=0, Scale="15")  # -> Mesh, FacePolylines
concat = Concatenate(FragmentA=f_ghfilepath.FilePath, FragmentB=subdir_name)
zoom = BooleanToggle(True)
lookahead = Slider(5, range=0..5)

# ----
# Double click to toggle
f_fro_2 = Froggle()

# ----
# Double click to toggle
f_fro_3 = Froggle()

# ----
# Use button to refresh alignment, or attach a Trigger for continuous alignment while navigating in Rhino
trigger = Trigger(Interval=-1, TimerInterval=5)
refresh = Button()
update = Button()
# save a named view in Rhino or load a file with named views, then hit update.
# 
# The component outputs the data to create corresponding cameras in Cinema4D
update_2 = Button()
pt_2 = Point(Point(77.91631543, 0, 0))
panel = Panel("Top")
f_camrep = CameraReport(Update=update)  # -> Location, Target, Lens, UpVector, NearClippingPlane, FarClippingPlane
f_nv2c4d = NamedViewsToCinema4D(Update=update_2)
f_o2cam = OrientToCamera(BasePoint=pt_2, Refresh=refresh)
f_vc2f = ViewCaptureToFile(
    FilePath=concat,
    FileName="screencap.png",
    ImageSize="1920x1080",
    Scale=1,
    Grid=False,
    Axes=False,
    Widget=False,
    Capture=f_fro_3)
multiplication_2 = Multiplication(A=eval.Tangent, B=lookahead)
f_tt = Turntable(
    Geometry=f_sphgen.Mesh,
    DistanceMultiplier=Slider(1.832, range=1..10),
    LensRange=Domain(21, 120),
    LensInterpolationParameter=Slider(0, range=0..1),
    Direction=cw,
    AdjustStartPoint=Slider(0.25, range=0..1),
    CameraTiltShift=Slider(0, range=-10..10),
    TargetTiltShift=Slider(0, range=-10..10),
    AnimationParameter=Slider(0, range=0..1),
    Activate=f_fro_2)
move = Move(Geometry=eval.Point, Motion=multiplication_2)  # -> Geometry, Transform
panel_2 = Panel(f_nv2c4d)
panel_3 = Panel(f_camrep.Location)
panel_4 = Panel(f_camrep.Target)
panel_5 = Panel(f_camrep.Lens)
panel_6 = Panel(f_camrep.UpVector)
panel_7 = Panel(f_camrep.NearClippingPlane)
panel_8 = Panel(f_camrep.FarClippingPlane)

activate_2 = Button()
f_fro_4 = Froggle(Button=activate_2)

tag = TextTag3D(
    Location=f_o2cam,
    Text="view-aligned text",
    Size="5",
    Colour=ColourSwatch(SwatchColor=RGB(255, 255, 255)),
    Justification=7)
Z = UnitZ(Factor=1)
f_camconz2geo = CameraControlAndZoomToGeometry(
    CameraType=-1,
    CameraLocation=eval.Point,
    TargetLocation=move.Geometry,
    Lens=Slider(21, range=21..120),
    UpVector=Z,
    ZoomFactor=0.1,
    Zoom=False,
    Activate=f_fro_4)
number_slider_2 = Slider(20, range=10..50)
pt_3 = Point(Point(418.8982485, 0, 0))
box = CenterBox(Base=pt_3, X=1, Y=1, Z=1)
pt_4 = Point(Point(383.0148735, 0, 0))
f_ghfilepath_2 = GHFilePathInfo()  # -> FileName, FilePath
f_sphgen_2 = SpaceFillingPolyhedraGenerator(BasePlane=pt_4, PolyhedronType=0, Scale="15")  # -> Mesh, FacePolylines
concat_2 = Concatenate(FragmentA=f_ghfilepath_2.FilePath, FragmentB="PointsValues.csv")
arrbox = BoxArray(Geometry=pt_3, Cell=box, XCount=number_slider_2, YCount=number_slider_2, ZCount=number_slider_2)  # -> Geometry, Transform
expression = Expression(x=arrbox.Geometry, y=Slider(0.1, range=0..1), Expression="pow(sin(x.X*y),2)*pow(sin(x.Z*y),2)+abs(cos(x.Y*y))")
Y = UnitY(Factor="30")
resolution = ValueList({"Coarse": 0, "Fine": 1, "Extra-Fine": 2, "ARE YOU NUTS??!?": 3}, selected="Extra-Fine")
file = ReadFile(File=concat_2, PerLineParse=True)
move_2 = Move(Geometry=f_sphgen_2.Mesh, Motion=Y)  # -> Geometry, Transform
split = TextSplit(Text=file, Separators=",")
my_slider = Slider(0.406, range=0..1)
integers = Slider(6, range=0..10)
values_a = Slider(3504.998, range=10..5000)
values_b = Slider(2868.99, range=10..8000)
pt_5 = Point(Point(477.3550096, 0, 0))
item = ListItem(List=split, Index=0, Wrap=True)  # -> Item, Item1, Item2, Item3
wbcatmullclark = WeaverbirdsCatmullClarkSubdivision(MeshCurves=move_2.Geometry, Level=Slider(3, range=1..3), SmoothNakedEdges=1)
xy = XYPlane(Origin=pt_5)
gradient_2 = Gradient(
    LowerLimit=0,
    UpperLimit=1,
    Parameter=expression,
    stops=[0: RGB(234, 38, 0), 0.25: RGB(234, 126, 0), 0.5: RGB(254, 244, 84), 0.75: RGB(173, 203, 249), 1: RGB(75, 107, 169)])
fresnel = BooleanToggle(True)
reflection = ColourSwatch(SwatchColor=RGB(255, 255, 255))
mesh = Mesh(flatten([f_sphgen_2.Mesh, wbcatmullclark]))
pt_6 = ConstructPoint(XCoordinate=item.Item, YCoordinate=item.Item1, ZCoordinate=item.Item2)  # -> flatten(Point)
emission = ColourSwatch(SwatchColor=RGB(0, 0, 0))
ambient = ColourSwatch(SwatchColor=RGB(0, 0, 0))
diffuse = ColourSwatch(SwatchColor=RGB(0, 0, 0))
num = Number(flatten(item.Item3))
f_matc = CustomMaterial(
    DiffuseColor=diffuse,
    AmbientColor=ambient,
    EmissionColor=emission,
    ReflectionColor=reflection,
    Reflectivity=Slider(1, range=0..1),
    ReflectionGlossiness=Slider(0.25, range=0..1),
    RefractionGlossiness=Slider(0, range=0..1),
    FresnelReflections=fresnel,
    IndexOfRefraction=Slider(1.2, range=1..2),
    Transparency=Slider(0, range=0..1))
# Use the Zoomable interface to add sliders input channels (1 slider per channel). Empty channels create spacers.
f_slvdisp = SliderValueDisplay(
    OrientationPlane=xy,
    SliderLength=Slider(20, range=10..100),
    TextFont="Arial",
    TextSize=Slider(0.5, range=0..2),
    BaseColor=ColourSwatch(SwatchColor=RGB(224, 224, 224)),
    HighlightColor=ColourSwatch(SwatchColor=RGB(0, 0, 0)),
    S0=my_slider,
    S1=integers,
    S3=values_a,
    S4=values_b)
f_wscd = WeightedSpheresCloudDisplay(Points=pt_6, Radius=num, Resolution=resolution)
f_cmvd = CustomMeshVerticesDisplay(Mesh=mesh, Color=ColourSwatch(SwatchColor=RGB(255, 255, 255)), Width=Slider(2, range=1..5))
f_cmwd = CustomMeshWiresDisplay(Mesh=mesh, Color=ColourSwatch(SwatchColor=RGB(103, 135, 194)), Width=Slider(2, range=1..5))
# or just plug a single color
f_pcd = PointCloudDisplay(Points=arrbox.Geometry, Colors=gradient_2, Size=Slider(3, range=1..5))
preview_2 = CustomPreview(Geometry=mesh, Material=f_matc)

# ---- group: a small polyhedra collection
pt_7 = Point(Point(209.3215625, 0, 0))
number_slider_3 = Slider(25, range=0..100)
random = Random(Range="0 To 5", Number=number_slider_3, Seed=3, Integers=True)
random_2 = Random(Range="5 To 15", Number=number_slider_3, Seed=2, Integers=False)
f_sphgen_3 = SpaceFillingPolyhedraGenerator(BasePlane=PlaneXY(0, 0, 0), PolyhedronType=random, Scale=random_2)  # -> Mesh, FacePolylines
wheel = ColourWheel(
    number_slider_3,
    ColourGrips_Style=20,
    ColourGrips_Grip=[4.020404268, 0.4732448222, 4.188790205, 3.141592654],
    ColourGrips_Lum=[0.1, 0.5],
    ColourGrips_Range=[0.4571663251, 0.4751886364, 0.2617993878, 0.2617993878],
    ColourGrips_Sat=[0.2, 0.6])
f_ifroml = IndexesFromList(Data=f_sphgen_3.Mesh)
Z_2 = UnitZ(Factor="30")

# ----
group = Group(Objects=f_sphgen_3.FacePolylines)  # -> flatten(Group)
merge = Merge(Data1=simplify(graft(f_sphgen_3.Mesh)), Data2=simplify(graft(group)))
group_2 = Group(Objects=merge)  # -> flatten(Group)

# ---- group: a small polyhedra collection (continued)
f_orientgrid = OrientOnGrid(
    Geometry=group_2,
    BasePlane=pt_7,
    PrimaryDimensionItems=Slider(5, range=5..10),
    XScale=1,
    YScale=1,
    RowFirst=Toggle(False))  # -> OrientedGeometry, BasePlanes, CellSize
ungroup = Ungroup(Group=f_orientgrid.OrientedGeometry)
move_3 = Move(Geometry=f_orientgrid.BasePlanes, Motion=Z_2)  # -> Geometry, Transform
tag_2 = TextTag3D(Location=move_3.Geometry, Text=f_ifroml, Size="5", Colour=ColourSwatch(SwatchColor=RGB(0, 0, 0)), Justification=5)

# ----
item_2 = ListItem(List=ungroup, Index=0, Wrap=True)  # -> flatten(Item), Item1
geo = Geometry(item_2.Item)
lng = ListLength(List=geo)  # -> expr("x-1", Length)
multiplication_3 = Multiplication(A=lng, B=selector)
item_3 = ListItem(List=geo, Index=multiplication_3, Wrap=True)
# 1. Select the viewport name (empty for active viewport) & Display mode (empty for current display mode)
# 
# 2. activate
# 
# 3. use the selector slider and... behold! My incredible polyhedra collection! Inspect them one by one, use Zoom factor to look closer or move away
f_camconz2geo_2 = CameraControlAndZoomToGeometry(
    Geometry=item_3,
    ViewportName="Top",
    CameraType=-1,
    DisplayMode="Rendered",
    ZoomFactor=Slider(-0.05, range=-2..2),
    Zoom=zoom,
    Activate=f_fro)

# ---- group: a small polyhedra collection (continued)
ungroup_2 = Ungroup(Group=item_2.Item1)
preview_3 = CustomPreview(Geometry=item_2.Item, Material=wheel)
