# Grasshopper definition Custom Curve Display.gh (Grasshopper 1.0.7)
# Copyright: Co-de-iT
# plug-ins: FileToScript, Human

sub_folder = Panel("froGH")
file_name_extension = Panel("Custom Curves Display.cs")
dir_type = ValueList({"desktop": 0, "documents": 1, "GH file path": 2, "C:": 3}, selected="GH file path")
f_pathg = PathGenerator(type=dir_type, subDir=sub_folder)  # -> dir; inputs type: Int32, subDir: String
# ---------- f_pathg: C# ----------
                           /*
    froGH - a sparse collection of (in)utilities for Grasshopper

    Path Generator
    code by Alessio Erioli - value list generation based on code by James Ramsden

    froGH by Co-de-iT is licensed under a Creative Commons Attribution 4.0 International License.
    http://creativecommons.org/licenses/by/4.0/

    */
    initComp();


    String S = "";
    String root = "";
    String end = "\\";
    String eol = Environment.NewLine;

    // __________________ autoList part __________________

    // variable for the list
    Grasshopper.Kernel.Special.GH_ValueList vList;
    // tries to cast input as list
    try{

      // if the list is not the first parameter then change Input[0] to the corresponding value
      vList = (Grasshopper.Kernel.Special.GH_ValueList) Component.Params.Input[0].Sources[0];
      // Print("value list connected");
      // check if the list must be created
      //if (vList.NickName != "dir type"){
      if (!vList.NickName.Equals("dir type")){
        vList.ClearData();
        vList.ListItems.Clear();
        vList.NickName = "dir type";
        var item1 = new Grasshopper.Kernel.Special.GH_ValueListItem("desktop", "0");
        var item2 = new Grasshopper.Kernel.Special.GH_ValueListItem("documents", "1");
        var item3 = new Grasshopper.Kernel.Special.GH_ValueListItem("GH file path", "2");
        var item4 = new Grasshopper.Kernel.Special.GH_ValueListItem("C:", "3");
        vList.ListItems.Add(item1);
        vList.ListItems.Add(item2);
        vList.ListItems.Add(item3);
        vList.ListItems.Add(item4);

        vList.ListItems[0].Value.CastTo(out type);
      }
    }
    catch{
      // handles anything that is not a value list
    }


    switch(type){
      case 0:
        root = Environment.GetFolderPath(Environment.SpecialFolder.Desktop) + end;
        S = "Desktop";
        break;
      case 1:
        root = Environment.GetFolderPath(Environment.SpecialFolder.MyDocuments) + end;
        S = "Documents";
        break;
      case 2:
        GH_Document ghDoc = owner.OnPingDocument();

        if (ghDoc.IsFilePathDefined)
        {
          int nameLen = ghDoc.DisplayName.TrimEnd('*').Length + 3; // +3 accounts for the '.gh' extension
          int fileLen = ghDoc.FilePath.TrimEnd('*').Length;

          //F = ghDoc.DisplayName.TrimEnd('*');
          root = ghDoc.FilePath.Substring(0, fileLen - nameLen);
          //root = gh_d.FilePath;
          S = "GH File path";
        }
        else
        {
          Print("No path defined. Saving to Desktop until then");
          root = Environment.GetFolderPath(Environment.SpecialFolder.Desktop);
          S = "Desktop";
        }
        break;
      case 3:
        root = "C:" + end;
        S = root + end;
        break;
    }
    dir = root + (subDir != null ? (subDir + end) : "");
    Component.Message = S;
# ---------- f_pathg: C# additional code ----------
  void initComp(){
    Component.Name = "Path Generator";
    Component.NickName = "f_PathG";
    Component.Description = "generates a path based on local direcories such as Desktop, Documents, GH file path";
    Component.Params.Input[0].Name = "dir type";
    Component.Params.Input[0].Description = "directory type: 0 desktop, 1 documents, 2 GH file path, 3 C:\nconnect a value list for automatic list generation";
    Component.Params.Input[1].Name = "custom subdir";
    Component.Params.Input[1].Description = "(optional) custom subdirectory";
  }
# ---------- end f_pathg ----------
concat = Concatenate(FragmentA=f_pathg, FragmentB=file_name_extension)
path = FilePath(concat)
number_slider = Slider(10, range=10..40)
pop2d = Populate2D(Region={Plane=PlaneXY(0, 0, 0), Size=Domain2(u=0..20, v=0..10)}, Count=number_slider, Seed=1)
repeat = RepeatData(Data="1", Length=number_slider)
range = Range(Domain="0.2 to 0.6", Steps=Slider(10, range=10..1000))
metaball_t = MetaBallTCustom(Points=pop2d, Charge=repeat, Plane=PlaneXY(0, 0, 0), Threshold=range)  # -> flatten(Isocurve)
# <title>
# 
# <description>
# 
# code by Alessio Erioli
# 
# v 0.1
move = Move(Geometry=metaball_t, Motion=Vector(0, 0, 10))  # -> Geometry, Transform
swatch = ColourSwatch(SwatchColor=RGB(255, 0, 0))
f_ccd = CustomCurveDisplay(C=metaball_t, col=swatch, W="2")  # -> out; inputs C: Curve, col: Color, W: Int32
# ---------- f_ccd: C# usings ----------
using System.Drawing;
using Grasshopper.Kernel.Components;
# ---------- f_ccd: C# ----------
        /*
      froGH - a sparse collection of (in)utilities for Grasshopper

      Custom Curve Display

      code by Alessio Erioli

      froGH by Co-de-iT is licensed under a Creative Commons Attribution 4.0 International License.
      http://creativecommons.org/licenses/by/4.0/

      */

        initComp();


        //GH_CustomPreviewItem item = default(GH_CustomPreviewItem);

        //item.Geometry = (IGH_PreviewData)C;

            //if (cur is IGH_PreviewData) Print("ok");
            _clip = BoundingBox.Union(_clip, C.GetBoundingBox(false));
            _curve.Add(C);
            _color.Add(col);
            _width.Add(W);


        
        //item.Geometry =
# ---------- f_ccd: C# additional code ----------
 
    private BoundingBox _clip;
    private List<Curve> _curve = new List<Curve>();
    private List<Color> _color = new List<Color>();
    private List<int> _width = new List<int>();

    void initComp()
    {
        Component.Name = "Custom Curve Display";
        Component.NickName = "f_CCD";
        Component.Description = "Render-compatible custom curve display";
        Component.Params.Input[0].Name = "Curves";
        Component.Params.Input[0].Description = "Curves to display";
        Component.Params.Input[1].Name = "Colour";
        Component.Params.Input[1].Description = "Display colour";
        Component.Params.Input[2].Name = "Width";
        Component.Params.Input[2].Description = "Display width";
    }


    /// <summary>
    /// This method will be called once every solution, before any calls to RunScript.
    /// </summary>
    public override void BeforeRunScript()
    {
        _clip = BoundingBox.Empty;
        _curve.Clear();
        _color.Clear();
        _width.Clear();
    }
    /// <summary>
    /// This method will be called once every solution, after any calls to RunScript.
    /// </summary>
    public override void AfterRunScript()
    { }


    //Return a BoundingBox that contains all the geometry you are about to draw.
    public override BoundingBox ClippingBox
    {
        get { return _clip; }
    }

    //Draw all meshes in this method.
    public override void DrawViewportMeshes(IGH_PreviewArgs args)
    {
    }

    //Draw all wires and points in this method.
    public override void DrawViewportWires(IGH_PreviewArgs args)
    {
        for (int i = 0; i < _curve.Count; i++)
            args.Display.DrawCurve(_curve[i], _color[i], _width[i]);
    }
# ---------- end f_ccd ----------
previewlw = CustomPreviewLineweights(Geometry=move.Geometry, Shader=ColourSwatch(SwatchColor=RGB(108, 186, 65)), Absolute=False)
ftsv2 = FileToScriptV2(File=path)
f_ccd_2 = CustomCurveDisplay(C=metaball_t, col=swatch, W="2")  # -> out; inputs C: list of Curve, col: Color, W: Int32; disabled
# ---------- f_ccd_2: C# ----------
        /*
      froGH - a sparse collection of (in)utilities for Grasshopper

      Custom Curve Display

      code by Alessio Erioli

      froGH by Co-de-iT is licensed under a Creative Commons Attribution 4.0 International License.
      http://creativecommons.org/licenses/by/4.0/

      */

        initComp();


        GH_CustomPreviewItem item = default(GH_CustomPreviewItem);


        foreach (Curve cur in C)
        {
            if (cur is IGH_PreviewData) Print("ok");
            _clip = BoundingBox.Union(_clip, cur.GetBoundingBox(false));
            _curve.Add(cur);
            _color.Add(col);
            _width.Add(W);
        }

        
        //item.Geometry =
# ---------- f_ccd_2: C# additional code ----------
 
    private BoundingBox _clip;
    private List<Curve> _curve = new List<Curve>();
    private List<Color> _color = new List<Color>();
    private List<int> _width = new List<int>();

    void initComp()
    {
        Component.Name = "Custom Curve Display";
        Component.NickName = "f_CCD";
        Component.Description = "Render-compatible custom curve display";
        Component.Params.Input[0].Name = "Curves";
        Component.Params.Input[0].Description = "Curves to display";
        Component.Params.Input[1].Name = "Colour";
        Component.Params.Input[1].Description = "Display colour";
        Component.Params.Input[2].Name = "Width";
        Component.Params.Input[2].Description = "Display width";
    }


    /// <summary>
    /// This method will be called once every solution, before any calls to RunScript.
    /// </summary>
    public override void BeforeRunScript()
    {
        _clip = BoundingBox.Empty;
        _curve.Clear();
        _color.Clear();
        _width.Clear();
    }
    /// <summary>
    /// This method will be called once every solution, after any calls to RunScript.
    /// </summary>
    public override void AfterRunScript()
    { }


    //Return a BoundingBox that contains all the geometry you are about to draw.
    public override BoundingBox ClippingBox
    {
        get { return _clip; }
    }

    //Draw all meshes in this method.
    public override void DrawViewportMeshes(IGH_PreviewArgs args)
    {
    }

    //Draw all wires and points in this method.
    public override void DrawViewportWires(IGH_PreviewArgs args)
    {
        for (int i = 0; i < _curve.Count; i++)
            args.Display.DrawCurve(_curve[i], _color[i], _width[i]);
    }
# ---------- end f_ccd_2 ----------
panel = Panel(f_ccd)
