# Grasshopper definition Fabrication.gh (Grasshopper 1.0.7)
# Copyright: Co-de-iT
# plug-ins: MeshEdit Components

# ---- group: angle testing
number_slider = Slider(0, range=0..6.283)  # disabled
xy = XYPlane(Origin=Point(0, 0, 0))  # disabled
X = UnitX(Factor=1)  # disabled
pt = Point(Point(1.179162172, 1.860501314, 0))  # disabled
pt_2 = Point(Point(2.171861041, 0.2235811759, 1.620056507))  # disabled
pt_3 = Point(Point(0, 2.830554986, 0))  # disabled
prot = RotatePlane(Plane=xy, Angle=number_slider)  # disabled
toggle = BooleanToggle(False)  # disabled
rot3d = Rotate3D(Geometry=xy, Angle=number_slider, Center=Point(0, 0, 0), Axis=X)  # -> Geometry, Transform; disabled
subtraction = Subtraction(A=pt_3, B=pt)  # disabled
subtraction_2 = Subtraction(A=pt_2, B=pt)  # disabled
deplane = DeconstructPlane(Plane=rot3d.Geometry)  # -> Origin, XAxis, YAxis, ZAxis; disabled
filter = StreamFilter(Gate=toggle, Stream0=pt, Stream1=deplane.Origin)  # disabled
filter_2 = StreamFilter(Gate=toggle, Stream0=subtraction_2, Stream1=deplane.XAxis)  # disabled
filter_3 = StreamFilter(Gate=toggle, Stream0=subtraction, Stream1=deplane.YAxis)  # disabled
pl = ConstructPlane(Origin=filter, XAxis=filter_2, YAxis=filter_3)  # disabled
angle = Angle(VectorA=subtraction_2, VectorB=subtraction, Plane=pl)  # -> Angle, Reflex; disabled
c_script = CSharpScript(O=filter, x=filter_2, y=filter_3)  # -> out, pX, pY, A, C; inputs O: Point3d, x: Vector3d, y: Vector3d; disabled
# ---------- c_script: C# ----------
    double angle;
    Point3d newX, newY;
    C = IsConvex(O, x, y, out angle, out newX, out newY);
    A = angle;
    pX = newX;
    pY = newY;
# ---------- c_script: C# additional code ----------
  public bool IsConvex(Point3d elbow, Vector3d previousEdge, Vector3d nextEdge, out double angle, out Point3d pX, out Point3d pY)
  {
    // this assumes nextEdge and previousEdge are vectors pointing out of a vertex and to the connected ones
    Plane p = new Plane(elbow, previousEdge, nextEdge);

    Point3d x, y;
    p.RemapToPlaneSpace((Point3d) elbow + previousEdge, out x);
    p.RemapToPlaneSpace((Point3d) elbow + nextEdge, out y);
//    angle = ((Math.Atan2(y.Y, y.X) - Math.Atan2(x.Y, x.X) + Math.PI * 2) % (Math.PI * 2)) - Math.PI;
    //angle = ((Math.Atan2(nextEdge.X, nextEdge.Y) - Math.Atan2(previousEdge.X, previousEdge.Y) + Math.PI * 2) % (Math.PI * 2)) - Math.PI;
    angle = AngSign((Vector3d) x, (Vector3d) y);
    pX = x;
    pY = y;
    return angle < 0;
    //    if (angle < 0) {
    //      corner.type = 'convex';
    //    } else if (angle > 0) {
    //      corner.type = 'concave';
    //    } else {
    //      corner.type = 'straight';
    //    }
  }
  
  double AngSign(Vector3d v1, Vector3d v2){
    v1.Unitize();
    v2.Unitize();
    return (Math.Atan2(v2.Y, v2.X) - Math.Atan2(v1.Y, v1.X));
  }
# ---------- end c_script ----------
f_vangsign = VectorAngleWithSign(V1=c_script.pX, V2=c_script.pY)  # -> A; inputs V1: Vector3d, V2: Vector3d, Z: Vector3d; disabled
# ---------- f_vangsign: C# ----------
           /*
    froGH - a sparse collection of (in)utilities for Grasshopper

    Vector angle with Sign v 0.1
    code by Alessio Erioli

    froGH by Co-de-iT is licensed under a Creative Commons Attribution 4.0 International License.
    http://creativecommons.org/licenses/by/4.0/

    */
    initComp();
    // maps vector coordinates to the plane space
    if (Z.IsZero) Z = Vector3d.ZAxis;
    Plane p = new Plane(new Point3d(0, 0, 0), V1, Z);
    p.Rotate(-Math.PI * 0.5, V1);
    Point3d p1,p2;
    p.RemapToPlaneSpace((Point3d) V1, out p1);
    p.RemapToPlaneSpace((Point3d) V2, out p2);

    A = angSign((Vector3d) p1, (Vector3d) p2);
# ---------- f_vangsign: C# additional code ----------
  void initComp(){
    Component.Name = "Vector Angle with sign";
    Component.NickName = "f_VAngSign";
    Component.Description = "Computes angle between vectors with direction-dependent sign:\nclockwise is -, counter-clockwise is +";
    Component.Params.Input[0].Name = "Vector 1";
    Component.Params.Input[0].Description = "first vector";
    Component.Params.Input[1].Name = "Vector 2";
    Component.Params.Input[1].Description = "second vector";
    Component.Params.Input[2].Name = "Z axis";
    Component.Params.Input[2].Description = "Z axis of reference plane - keep empty for World Z";
    Component.Params.Output[0].Name = "Angle";
    Component.Params.Output[0].Description = "Angle (with sign) between vectors";
  }

  double angSign(Vector3d v1, Vector3d v2){
    v1.Unitize();
    v2.Unitize();
    return (System.Math.Atan2(v2.Y, v2.X) - System.Math.Atan2(v1.Y, v1.X));
  }
# ---------- end f_vangsign ----------
panel = Panel(angle.Angle)  # disabled
deg = Degrees(Radians=c_script.A)  # disabled
deg_2 = Degrees(Radians=f_vangsign)  # disabled
panel_2 = Panel([deg, c_script.C])  # disabled
panel_3 = Panel(deg_2)  # disabled

# ---- group: mesh naked edges as polylines
c_script_2 = CSharpScript()  # -> Np; inputs M: Mesh; disabled
# ---------- c_script_2: C# ----------
    Np = M.GetNakedEdges();
# ---------- end c_script_2 ----------

# ---- group: length control & debug
c_script_3 = CSharpScript()  # -> out, bV, bA, CL; inputs M: list of Mesh, A: Double, D: Double; disabled
# ---------- c_script_3: C# usings ----------
using System.Drawing;
using System.Threading.Tasks;
using System.Linq;
using Microsoft.Win32.SafeHandles;
# ---------- c_script_3: C# ----------
    if (M == null) return;

    double tol = Rhino.RhinoDoc.ActiveDoc.ModelAbsoluteTolerance;
    double biAng = 0;
    Point3d current, previous, next;
    List<Point3d> flapPoints;
    Vector3d incoming, outgoing, zAxis, biSect, vPrev, vNext;
    int cW;

    DataTree<Vector3d> bisects = new DataTree<Vector3d>();
    DataTree<double> biAngs = new DataTree<double>();
    DataTree<Polyline> Flaps = new DataTree<Polyline>();


    for (int k = 0; k < M.Count; k++)
    {

      Polyline[] nakedEdges = M[k].GetNakedEdges();
      Polyline[] flapCurves = new Polyline[nakedEdges.Length];

      // verify that naked edges are closed polylines
      bool isClosed = true;
      foreach (Polyline nEdge in nakedEdges)
        isClosed &= nEdge.IsClosed;

      if (!isClosed) return;

      for (int i = 0; i < nakedEdges.Length; i++)
      {

        cW = IsClockWise(nakedEdges[i]) ? -1 : 1; // is polyline clockwise?
        // Print("cW: {0}", cW == -1 ? "yes" : "no");

        flapPoints = new List<Point3d>();

        // remove duplicate point at start/endpoint
        nakedEdges[i].RemoveAt(nakedEdges[i].Count - 1);
        int nPoints = nakedEdges[i].Count;

        int prevInd, nextInd;

        Vector3d[,] OffsetVectors = new Vector3d[nPoints, 2];
        double[] OffsetAngles = new double[nPoints];

        // find bisector vectors and angles
        for (int j = 0; j < nPoints; j++)
        {
          prevInd = (j - 1 + nPoints) % nPoints;
          nextInd = (j + 1) % nPoints;

          current = nakedEdges[i][j];
          previous = nakedEdges[i][prevInd];
          next = nakedEdges[i][nextInd];

          incoming = previous - current;
          outgoing = next - current;
          double incomingLength = incoming.Length;
          double outgoingLength = outgoing.Length;
          incoming.Unitize();
          outgoing.Unitize();
          zAxis = Vector3d.CrossProduct(incoming, outgoing) * cW;

          // check if this elbow is convex or concave (referring to the angle inside the polyline)
          int convex = IsConvex(cW, current, incoming, outgoing, out biAng) ? cW : -cW;

          // Print("{0}", convex == 1 ? "convex" : "concave");

          // angle correction to get the exact bisector angle
          biAng *= 0.5;
          biSect = -(incoming + outgoing) * convex;// * cW;
          biSect.Unitize();
          bisects.Add(biSect, new GH_Path(k, i));
          biAngs.Add(biAng, new GH_Path(k, i));

          // rotation & angle check
          double angle = A < biAng ? A * convex * cW : biAng * convex * cW;

          // vectors for incoming and outgoing directions from a vertex
          vPrev = incoming;
          vNext = outgoing;
          double dist = D / Math.Abs(Math.Sin(angle));
          //double distP = D / Math.Abs(Math.Sin(angle));

          // length check
          double maxLPrev, maxLNext;
          maxLPrev = incomingLength * 0.5 / Math.Abs(Math.Cos(angle));
          maxLNext = outgoingLength * 0.5 / Math.Abs(Math.Cos(angle));

          vPrev *= Math.Min(dist, maxLPrev); //dist;
          vNext *= Math.Min(dist, maxLNext); //dist;

          vPrev.Rotate(-angle, zAxis);
          vNext.Rotate(angle, zAxis);

          OffsetVectors[j, 0] = vPrev;
          OffsetVectors[j, 1] = vNext;
          OffsetAngles[j] = angle;

        }

        double hMin, hsFactorStart, hsFactorEnd;
        Vector3d vStart, vEnd;
        Point3d fStart, fEnd;
        // verify offsets and generate flap points
        for (int j = 0; j < nPoints; j++)
        {

          nextInd = (j + 1) % nPoints;
          current = nakedEdges[i][j];
          vStart = OffsetVectors[j, 1];
          vEnd = OffsetVectors[nextInd, 0];

          hsFactorStart = Math.Abs(Math.Sin(OffsetAngles[j]));
          hsFactorEnd = Math.Abs(Math.Sin(OffsetAngles[nextInd]));

          hMin = Math.Min(vStart.Length * hsFactorStart, vEnd.Length * hsFactorEnd);
          vStart.Unitize();
          vEnd.Unitize();
          vStart *= hMin / hsFactorStart;
          vEnd *= hMin / hsFactorEnd;

          // generate flap points and add them to the array
          fStart = current + vStart;
          fEnd = nakedEdges[i][nextInd] + vEnd;
          flapPoints.Add(current);
          flapPoints.Add(fStart);
          flapPoints.Add(fEnd);

        }

        // add again first point to get closed polyline
        flapPoints.Add(flapPoints[0]);
        flapCurves[i] = new Polyline(flapPoints);

      }
      Flaps.AddRange(flapCurves, new GH_Path(k));
    }

    bA = biAngs;
    bV = bisects;
    CL = Flaps;
    //Print("end of script");
# ---------- c_script_3: C# additional code ----------
  /// <summary>
  /// Is polyline clockwise - determines if a polyline is clockwise or not
  /// </summary>
  /// <param name="poly">the Polyline to inspect</param>
  /// <returns>true for cw, false for ccw</returns>
  /// <remarks>code from https://stackoverflow.com/questions/1165647/how-to-determine-if-a-list-of-polygon-points-are-in-clockwise-order \nImplemented in VBNet by Mateusz Zwierzycki</remarks>
  public bool IsClockWise(Polyline poly)
  {
    double sum = 0;
    foreach (Line s in poly.GetSegments())
      sum += (s.To.X - s.From.X) * (s.To.Y + s.From.Y);

    return sum > 0;
  }

  public bool IsConvex(int cW, Point3d elbow, Vector3d previousEdge, Vector3d nextEdge, out double angle)
  {
    // this assumes nextEdge and previousEdge are vectors pointing out of a vertex and to the connected ones
    Plane p = new Plane(elbow, previousEdge, nextEdge);
    Point3d x, y;
    p.RemapToPlaneSpace((Point3d) elbow + previousEdge, out x);
    p.RemapToPlaneSpace((Point3d) elbow + nextEdge, out y);

    double convex = ((Math.Atan2(nextEdge.X, nextEdge.Y) - Math.Atan2(previousEdge.X, previousEdge.Y) + Math.PI * 2) % (Math.PI * 2)) - Math.PI;
    //angle = AngSign((Vector3d)x, (Vector3d)y);// + Math.PI*Convert.ToInt32(convex <0);

    angle = convex * cW < 0 ? 2 * Math.PI - AngSign((Vector3d) x, (Vector3d) y) : AngSign((Vector3d) x, (Vector3d) y);

    return convex < 0;
    //    if (angle < 0) {
    //      corner.type = 'convex';
    //    } else if (angle > 0) {
    //      corner.type = 'concave';
    //    } else {
    //      corner.type = 'straight';
    //    }
  }

  double AngSign(Vector3d v1, Vector3d v2)
  {
    v1.Unitize();
    v2.Unitize();
    return (Math.Atan2(v2.Y, v2.X) - Math.Atan2(v1.Y, v1.X));
  }
# ---------- end c_script_3 ----------

# ----
multiplication = Multiplication(A=c_script_3.bA, B="2")
explode = Explode(Curve=c_script_2, Recursive=True)  # -> Segments, Vertices
subtraction_3 = Subtraction(A="2*Pi", B=multiplication)
deg_3 = Degrees(Radians=subtraction_3)
deg_4 = Degrees(Radians=multiplication)
cull_i = CullIndex(List=explode.Vertices, Indices="-1", Wrap=True)
vdisex = VectorDisplayEx(Point=cull_i, Vector=explode.Segments, Colour=ColourSwatch(SwatchColor=RGB(247, 255, 0)), Width=2)
f_dbshift = DoubleShift(list=cull_i, wrap="true")  # -> forward, backwards
cir = Circle(Plane=cull_i, Radius=Slider(2.181, range=0..5))
shift = ShiftList(List=explode.Segments, Shift=1, Wrap=True)
panel_4 = Panel(deg_3)
panel_5 = Panel(deg_4)
panel_6 = Panel(c_script_3.bA)
angle_2 = Angle(VectorA=explode.Segments, VectorB=shift)  # -> Angle, Reflex
points = PointList(Points=cull_i, Size="1")  # disabled
Z = UnitZ(Factor=1)
circledim = CircularDimension(Circle=cir, PointA=f_dbshift.forward, PointB=f_dbshift.backwards, Text="{0:0.0}°", Size="0.5")  # disabled
deg_5 = Degrees(Radians=angle_2.Angle)
vrot = Rotate(Vector=c_script_3.bV, Axis=Z, Angle=c_script_3.bA)
panel_7 = Panel(deg_5)
vdisex_2 = VectorDisplayEx(Point=cull_i, Vector=vrot, Colour=ColourSwatch(SwatchColor=RGB(255, 255, 255)), Width=2)

sub_folder = Panel("froGH")
file_name_extension = Panel("Flapper.cs")
dir_type = ValueList({"desktop": 0, "documents": 1, "GH file path": 2, "C:": 3}, selected="GH file path")

# ---- group: bisect vectors
vdisex_3 = VectorDisplayEx(Point=cull_i, Vector=c_script_3.bV, Colour=RGB(0, 0, 0), Width=2)

# ----
f_pathg = PathGenerator(type=dir_type, subDir=sub_folder)  # -> dir; inputs type: Int32, subDir: String
# ---------- f_pathg: C# ----------
                           /*
    froGH - a sparse collection of (in)utilities for Grasshopper

    Path Generator
    code by Alessio Erioli - value list generation based on code by James Ramsden

    froGH by Co-de-iT is licensed under a Creative Commons Attribution 4.0 International License.
    http://creativecommons.org/licenses/by/4.0/

    */
    initComp();


    String S = "";
    String root = "";
    String end = "\\";
    String eol = Environment.NewLine;

    // __________________ autoList part __________________

    // variable for the list
    Grasshopper.Kernel.Special.GH_ValueList vList;
    // tries to cast input as list
    try{

      // if the list is not the first parameter then change Input[0] to the corresponding value
      vList = (Grasshopper.Kernel.Special.GH_ValueList) Component.Params.Input[0].Sources[0];
      // Print("value list connected");
      // check if the list must be created
      //if (vList.NickName != "dir type"){
      if (!vList.NickName.Equals("dir type")){
        vList.ClearData();
        vList.ListItems.Clear();
        vList.NickName = "dir type";
        var item1 = new Grasshopper.Kernel.Special.GH_ValueListItem("desktop", "0");
        var item2 = new Grasshopper.Kernel.Special.GH_ValueListItem("documents", "1");
        var item3 = new Grasshopper.Kernel.Special.GH_ValueListItem("GH file path", "2");
        var item4 = new Grasshopper.Kernel.Special.GH_ValueListItem("C:", "3");
        vList.ListItems.Add(item1);
        vList.ListItems.Add(item2);
        vList.ListItems.Add(item3);
        vList.ListItems.Add(item4);

        vList.ListItems[0].Value.CastTo(out type);
      }
    }
    catch{
      // handles anything that is not a value list
    }


    switch(type){
      case 0:
        root = Environment.GetFolderPath(Environment.SpecialFolder.Desktop) + end;
        S = "Desktop";
        break;
      case 1:
        root = Environment.GetFolderPath(Environment.SpecialFolder.MyDocuments) + end;
        S = "Documents";
        break;
      case 2:
        GH_Document ghDoc = owner.OnPingDocument();

        if (ghDoc.IsFilePathDefined)
        {
          int nameLen = ghDoc.DisplayName.TrimEnd('*').Length + 3; // +3 accounts for the '.gh' extension
          int fileLen = ghDoc.FilePath.TrimEnd('*').Length;

          //F = ghDoc.DisplayName.TrimEnd('*');
          root = ghDoc.FilePath.Substring(0, fileLen - nameLen);
          //root = gh_d.FilePath;
          S = "GH File path";
        }
        else
        {
          Print("No path defined. Saving to Desktop until then");
          root = Environment.GetFolderPath(Environment.SpecialFolder.Desktop);
          S = "Desktop";
        }
        break;
      case 3:
        root = "C:" + end;
        S = root + end;
        break;
    }
    dir = root + (subDir != null ? (subDir + end) : "");
    Component.Message = S;
# ---------- f_pathg: C# additional code ----------
  void initComp(){
    Component.Name = "Path Generator";
    Component.NickName = "f_PathG";
    Component.Description = "generates a path based on local direcories such as Desktop, Documents, GH file path";
    Component.Params.Input[0].Name = "dir type";
    Component.Params.Input[0].Description = "directory type: 0 desktop, 1 documents, 2 GH file path, 3 C:\nconnect a value list for automatic list generation";
    Component.Params.Input[1].Name = "custom subdir";
    Component.Params.Input[1].Description = "(optional) custom subdirectory";
  }
# ---------- end f_pathg ----------
concat = Concatenate(FragmentA=f_pathg, FragmentB=file_name_extension)
path = FilePath(concat)
# H=L/2 tan(a)
number_slider_2 = Slider(0, range=-3.141..3.142)
yz = YZPlane(Origin=Point(0, 0, 0))

# ---- group: unrolled mesh strip
mesh = Mesh(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)

# ---- group: planar meshes
mesh_2 = Mesh([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])

# ----
yz_2 = YZPlane(Origin=Point(0, 0, 0))
rotate = Rotate(Geometry=mesh_2, Angle=number_slider_2, Plane=yz)  # -> Geometry, Transform
rotate_2 = Rotate(Geometry=mesh, Angle=Slider(0, range=-3.141..3.142), Plane=yz_2)  # -> Geometry, Transform
weldvertices = MeshWeldVertices(Mesh=rotate.Geometry, Tolerance=0.01)  # -> RuntimeMessage, Mesh
# <title>
# 
# <description>
# 
# code by Alessio Erioli
# 
# v 0.1
# © Co-de-iT 2020 / Creative Commons Attribution-Non Commercial-ShareAlike 4.0 International License
merge = Merge(Data1=rotate_2.Geometry, Data2=weldvertices.Mesh)
angle_3 = Slider(1.571, range=0..1.571)

# ---- group: new Flapper
# flapper
f_flap = Flapper(M=merge, A=angle_3, D=Slider(2.995, range=0..20))  # -> Fi, Fo, CL; inputs M: list of Mesh, A: Double, D: Double
# ---------- f_flap: C# usings ----------
using System.Threading.Tasks;
using System.Linq;
# ---------- f_flap: C# ----------
         /*
         froGH - a sparse collection of (in)utilities for Grasshopper

         Flapper

         code by Alessio Erioli

         froGH by Co-de-iT is licensed under a Creative Commons Attribution 4.0 International License.
         http://creativecommons.org/licenses/by/4.0/

         */

        InitComp();

        if (M == null) return;

        double biAng = 0;
        Point3d current, previous, next;
        List<Point3d> flapPoints;
        Vector3d incoming, outgoing, zAxis, biSect, vPrev, vNext;
        int cW;

        DataTree<Polyline> Flaps = new DataTree<Polyline>();
        DataTree<GH_Line> FoldInnerEdges = new DataTree<GH_Line>();
        DataTree<GH_Line> FoldOuterEdges = new DataTree<GH_Line>();

        for (int k = 0; k < M.Count; k++)
        {

            FoldInnerEdges.AddRange(GetClothedEdges(M[k]).Select(l => new GH_Line(l)).ToArray(), new GH_Path(k));

            Polyline[] nakedEdges = M[k].GetNakedEdges();
            Polyline[] flapCurves = new Polyline[nakedEdges.Length];

            // verify that naked edges are closed polylines
            bool isClosed = true;
            foreach (Polyline nEdge in nakedEdges)
                isClosed &= nEdge.IsClosed;

            if (!isClosed) return;

            for (int i = 0; i < nakedEdges.Length; i++)
            {
                // add segments to outer edges Data Tree
                FoldOuterEdges.AddRange(nakedEdges[i].GetSegments().Select(s => new GH_Line(s)).ToArray(), new GH_Path(k));

                cW = IsClockWise(nakedEdges[i]) ? -1 : 1; // is polyline clockwise?

                flapPoints = new List<Point3d>();

                // remove duplicate point at start/endpoint
                nakedEdges[i].RemoveAt(nakedEdges[i].Count - 1);
                int nPoints = nakedEdges[i].Count;

                int prevInd, nextInd;

                Vector3d[,] OffsetVectors = new Vector3d[nPoints, 2];
                double[] OffsetAngles = new double[nPoints];

                // find bisector vectors and angles
                for (int j = 0; j < nPoints; j++)
                {
                    prevInd = (j - 1 + nPoints) % nPoints;
                    nextInd = (j + 1) % nPoints;

                    current = nakedEdges[i][j];
                    previous = nakedEdges[i][prevInd];
                    next = nakedEdges[i][nextInd];

                    incoming = previous - current;
                    outgoing = next - current;
                    double incomingLength = incoming.Length;
                    double outgoingLength = outgoing.Length;
                    incoming.Unitize();
                    outgoing.Unitize();
                    zAxis = Vector3d.CrossProduct(incoming, outgoing) * cW;

                    // check if this elbow is convex or concave (referring to the angle inside the polyline)
                    int convex = IsConvex(cW, current, incoming, outgoing, out biAng) ? cW : -cW;

                    // angle correction to get the exact bisector angle
                    biAng *= 0.5;
                    biSect = -(incoming + outgoing) * convex;// * cW;
                    biSect.Unitize();

                    // rotation & angle check
                    double angle = A < biAng ? A * convex * cW : biAng * convex * cW;

                    // vectors for incoming and outgoing directions from a vertex
                    vPrev = incoming;
                    vNext = outgoing;
                    double dist = D / Math.Abs(Math.Sin(angle));
                    //double distP = D / Math.Abs(Math.Sin(angle));

                    // length check
                    double maxLPrev, maxLNext;
                    maxLPrev = incomingLength * 0.5 / Math.Abs(Math.Cos(angle));
                    maxLNext = outgoingLength * 0.5 / Math.Abs(Math.Cos(angle));

                    vPrev *= Math.Min(dist, maxLPrev); //dist;
                    vNext *= Math.Min(dist, maxLNext); //dist;

                    vPrev.Rotate(-angle, zAxis);
                    vNext.Rotate(angle, zAxis);

                    OffsetVectors[j, 0] = vPrev;
                    OffsetVectors[j, 1] = vNext;
                    OffsetAngles[j] = angle;

                }

                double hMin, hsFactorStart, hsFactorEnd;
                Vector3d vStart, vEnd;
                Point3d fStart, fEnd;

                // verify offsets and generate flap points
                for (int j = 0; j < nPoints; j++)
                {

                    nextInd = (j + 1) % nPoints;
                    current = nakedEdges[i][j];
                    vStart = OffsetVectors[j, 1];
                    vEnd = OffsetVectors[nextInd, 0];

                    hsFactorStart = Math.Abs(Math.Sin(OffsetAngles[j]));
                    hsFactorEnd = Math.Abs(Math.Sin(OffsetAngles[nextInd]));

                    hMin = Math.Min(vStart.Length * hsFactorStart, vEnd.Length * hsFactorEnd);
                    vStart.Unitize();
                    vEnd.Unitize();
                    vStart *= hMin / hsFactorStart;
                    vEnd *= hMin / hsFactorEnd;

                    // generate flap points and add them to the array
                    fStart = current + vStart;
                    fEnd = nakedEdges[i][nextInd] + vEnd;
                    flapPoints.Add(current);
                    flapPoints.Add(fStart);
                    flapPoints.Add(fEnd);

                }

                // add again first point to get closed polyline
                flapPoints.Add(flapPoints[0]);
                flapCurves[i] = new Polyline(flapPoints);

            }
            Flaps.AddRange(flapCurves, new GH_Path(k));

        }

        Fi = FoldInnerEdges;
        Fo = FoldOuterEdges;
        CL = Flaps;
# ---------- f_flap: C# additional code ----------
 

    void InitComp()
    {
        Component.Name = "Flapper";
        Component.NickName = "f_Flap";
        Component.Description = "builds flaps on a planar mesh naked edges\nsuggested use with mesh strips\nautomatic compensation for overlaps";
        Component.Params.Input[0].Name = "Mesh";
        Component.Params.Input[0].Description = "Input Mesh Strip";
        Component.Params.Input[1].Name = "Angle";
        Component.Params.Input[1].Description = "Flap tapering angle (0 - max tapering, 0.5 * Pi - perpendicular to edge)";
        Component.Params.Input[2].Name = "Distance";
        Component.Params.Input[2].Description = "Flap Offset Distance";
        Component.Params.Output[0].Name = "Fold inner edges";
        Component.Params.Output[0].Description = "Fold lines for inner (clothed) edges";
        Component.Params.Output[1].Name = "Fold outer edges";
        Component.Params.Output[1].Description = "Fold lines for outer (naked) edges";
        Component.Params.Output[2].Name = "Cut lines";
        Component.Params.Output[2].Description = "Cut lines for flaps";
    }


    /// <summary>
    /// Is polyline clockwise - determines if a polyline is clockwise or not
    /// </summary>
    /// <param name="poly">the Polyline to inspect</param>
    /// <returns>true for cw, false for ccw</returns>
    /// <remarks>code from https://stackoverflow.com/questions/1165647/how-to-determine-if-a-list-of-polygon-points-are-in-clockwise-order \nImplemented in VBNet by Mateusz Zwierzycki</remarks>
    public bool IsClockWise(Polyline poly)
    {
        double sum = 0;
        foreach (Line s in poly.GetSegments())
            sum += (s.To.X - s.From.X) * (s.To.Y + s.From.Y);

        return sum > 0;
    }

    public bool IsConvex(int cW, Point3d elbow, Vector3d previousEdge, Vector3d nextEdge, out double angle)
    {
        // this assumes nextEdge and previousEdge are vectors pointing out of a vertex and to the connected ones
        Plane p = new Plane(elbow, previousEdge, nextEdge);
        Point3d x, y;
        p.RemapToPlaneSpace((Point3d)elbow + previousEdge, out x);
        p.RemapToPlaneSpace((Point3d)elbow + nextEdge, out y);

        double convex = ((Math.Atan2(nextEdge.X, nextEdge.Y) - Math.Atan2(previousEdge.X, previousEdge.Y) + Math.PI * 2) % (Math.PI * 2)) - Math.PI;
        //angle = AngSign((Vector3d)x, (Vector3d)y);// + Math.PI*Convert.ToInt32(convex <0);

        angle = convex * cW < 0 ? 2 * Math.PI - AngSign((Vector3d)x, (Vector3d)y) : AngSign((Vector3d)x, (Vector3d)y);

        return convex < 0;
        //    if (angle < 0) {
        //      corner.type = 'convex';
        //    } else if (angle > 0) {
        //      corner.type = 'concave';
        //    } else {
        //      corner.type = 'straight';
        //    }
    }

    double AngSign(Vector3d v1, Vector3d v2)
    {
        v1.Unitize();
        v2.Unitize();
        return (Math.Atan2(v2.Y, v2.X) - Math.Atan2(v1.Y, v1.X));
    }

    List<Line> GetClothedEdges(Mesh M)
    {
        List<Line> cEdges = new List<Line>();
        for (int i = 0; i < M.TopologyEdges.Count; i++)
        {
            if (M.TopologyEdges.GetConnectedFaces(i).Length > 1)
                cEdges.Add(M.TopologyEdges.EdgeLine(i));
        }
        return cEdges;
    }
# ---------- end f_flap ----------

# ----
preview = CustomPreview(Geometry=f_flap.Fi, Material=ColourSwatch(SwatchColor=RGB(135, 135, 135)))
preview_2 = CustomPreview(Geometry=f_flap.Fo, Material=ColourSwatch(SwatchColor=RGB(0, 0, 0)))
preview_3 = CustomPreview(Geometry=f_flap.CL, Material=ColourSwatch(SwatchColor=RGB(255, 255, 255)))

# ---- group: font list select
f_fontls = FontListSelect()  # -> fonts, font; inputs i: Int32
# ---------- f_fontls: C# ----------
                                        /*
    froGH - a sparse collection of (in)utilities for Grasshopper

    Font List/Select
    based on code by Peter Fotiadis - tweaks by Alessio Erioli

    froGH by Co-de-iT is licensed under a Creative Commons Attribution 4.0 International License.
    http://creativecommons.org/licenses/by/4.0/

    */
    initComp();

    List<string> fontNames = FontFamily.Families.Select(f => f.Name).ToList();
    fonts = fontNames;

    int index = i % fontNames.Count; //"wrap" behavior
    font = fontNames[index];
# ---------- f_fontls: C# additional code ----------
  void initComp(){
    Component.Name = "Font List-Select";
    Component.NickName = "f_FontLS";
    Component.Description = "Lists fonts in the system and allows selection by index";
    Component.Params.Input[0].Name = "Font Index";
    Component.Params.Input[0].Description = "Index of Font to retrieve";

    Component.Params.Output[0].Name = "Fonts";
    Component.Params.Output[0].Description = "A list of all fonts in the system";
    Component.Params.Output[1].Name = "Font";
    Component.Params.Output[1].Description = "The retrieved font";

  }
# ---------- end f_fontls ----------

# ---- group: font list parser
f_fpars = FontParser()  # -> C; inputs S: String, font: String, close: Boolean, size: Double, prec: Double, P: Plane, J: Int32
#   port font: text font single-line font is suggested for fabrication i.e. laser cutting
#   port prec: sampling precision (usually 100-250 is ok)
# ---------- f_fpars: C# usings ----------
using System.IO;
using System.Linq;
using System.Data;
using System.Drawing;
using System.Reflection;
using System.Windows.Forms;
using System.Xml;
using System.Xml.Linq;
using System.Runtime.InteropServices;

using Rhino.DocObjects;
using Rhino.Collections;
using GH_IO;
using GH_IO.Serialization;
# ---------- f_fpars: C# ----------
                                                   /*
    froGH - a sparse collection of (in)utilities for Grasshopper

    Font Parser
    Adaptation of code written by David Rutten, Giulio Piacentino et al.
    Adaptation for C# by Alessio Erioli - Co-de-iT

    froGH by Co-de-iT is licensed under a Creative Commons Attribution 4.0 International License.
    http://creativecommons.org/licenses/by/4.0/

    */
    initComp();

    if (S != null){
      float fS = size == 0 ? 1 : (float) size;
      System.Drawing.Font local_font = new System.Drawing.Font(font, (float) fS);

      System.Drawing.Drawing2D.GraphicsPath path = new System.Drawing.Drawing2D.GraphicsPath();
      path.AddString(S, local_font.FontFamily, (int) local_font.Style, local_font.Size, new PointF(0, 0), new StringFormat());

      System.Drawing.Drawing2D.Matrix matrix = new  System.Drawing.Drawing2D.Matrix(); // transformation matrix
      matrix.Reset(); // build identity matrix

      // __________________ autoList part __________________

      // variable for the list
      Grasshopper.Kernel.Special.GH_ValueList vList;
      // tries to cast input as list
      try{

        // if the list is not the first parameter then change Input[6] to the corresponding value
        vList = (Grasshopper.Kernel.Special.GH_ValueList) Component.Params.Input[6].Sources[0];
        // Print("value list connected");
        // check if the list must be created
        //if (vList.NickName != "dir type"){
        if (!vList.NickName.Equals("justification")){
          vList.ClearData();
          vList.ListItems.Clear();
          vList.NickName = "justification";

          var item1 = new Grasshopper.Kernel.Special.GH_ValueListItem("top left", "0");
          var item2 = new Grasshopper.Kernel.Special.GH_ValueListItem("middle left", "1");
          var item3 = new Grasshopper.Kernel.Special.GH_ValueListItem("bottom left", "2");
          var item4 = new Grasshopper.Kernel.Special.GH_ValueListItem("top center", "3");
          var item5 = new Grasshopper.Kernel.Special.GH_ValueListItem("middle center", "4");
          var item6 = new Grasshopper.Kernel.Special.GH_ValueListItem("bottom center", "5");
          var item7 = new Grasshopper.Kernel.Special.GH_ValueListItem("top right", "6");
          var item8 = new Grasshopper.Kernel.Special.GH_ValueListItem("middle right", "7");
          var item9 = new Grasshopper.Kernel.Special.GH_ValueListItem("bottom right", "8");
          vList.ListItems.Add(item1);
          vList.ListItems.Add(item2);
          vList.ListItems.Add(item3);
          vList.ListItems.Add(item4);
          vList.ListItems.Add(item5);
          vList.ListItems.Add(item6);
          vList.ListItems.Add(item7);
          vList.ListItems.Add(item8);
          vList.ListItems.Add(item9);

          vList.ListItems[0].Value.CastTo(out J);
        }
      }
      catch{
        // handles anything that is not a value list
      }

      // ______________ text justification ______________

      RectangleF rec = path.GetBounds(); // bounding rectangle for text
      float dX = Convert.ToSingle(rec.Width * -0.5), dY = Convert.ToSingle(rec.Height * 0.5);
      switch(J){
        case 0:// top left
          dX = 0;
          dY = fS;
          break;
        case 1: // middle left
          dX = 0;
          dY = Convert.ToSingle((-rec.Height) * 0.5 + fS);
          break;
        case 2:  // bottom left
          dX = 0;
          dY = Convert.ToSingle(-rec.Height + fS * 0.5);
          break;
        case 3: // top center
          dX = Convert.ToSingle(rec.Width * -0.5);
          dY = fS;
          break;
        case 4: // middle center
          dX = Convert.ToSingle(rec.Width * -0.5);
          dY = Convert.ToSingle((-rec.Height) * 0.5 + fS);
          break;
        case 5: // bottom center
          dX = Convert.ToSingle(rec.Width * -0.5);
          dY = Convert.ToSingle(-rec.Height + fS * 0.5);
          break;
        case 6: // top right
          dX = Convert.ToSingle(rec.Width * -1);
          dY = fS;
          break;
        case 7: // middle right
          dX = Convert.ToSingle(rec.Width * -1);
          dY = Convert.ToSingle((-rec.Height) * 0.5 + fS);
          break;
        case 8: // bottom right
          dX = Convert.ToSingle(rec.Width * -1);
          dY = Convert.ToSingle(-rec.Height + fS * 0.5);
          break;

      }
      //float dX = Convert.ToSingle(rec.Width * -0.5);
      //float dY = Convert.ToSingle(rec.Height * 0.5);
      System.Drawing.Drawing2D.Matrix mTrans = new  System.Drawing.Drawing2D.Matrix(1, 0, 0, 1, dX, dY); // build transformation matrix
      path.Transform(mTrans); // transform text path

      // ______________ convert to polylines ______________

      path.Flatten(matrix, (float) (size / prec)); // turns the path into a polyline that approximates the path

      PointF[] pts = path.PathPoints; // get path points
      Byte[] tps = path.PathTypes;   // get path point types
      List<Polyline> strokes = new  List<Polyline>(); // List for strokes
      Polyline stroke = new Polyline();

      Byte typ_start = Convert.ToByte(System.Drawing.Drawing2D.PathPointType.Start);// find start points condition

      // the conversion loop
      for (int i = 0; i < pts.Length; i++){
        // if a start point is found, and the existing polyline is not null nor a single point,
        // add polyline to the strokes and create a new polyline
        if(tps[i] == typ_start){
          if (stroke != null && stroke.Count > 1) {
            if (close) stroke.Add(stroke[0]); // close polyline if necessary
            strokes.Add(stroke);}
          stroke = new Polyline();
        }
        // in any other case add the next point to a polyline
        stroke.Add(pts[i].X, -pts[i].Y + size, 0);
        // add last stroke to the list
        if (i == pts.Length - 1) {
          if (close) stroke.Add(stroke[0]); // and close it if necessary
          strokes.Add(stroke);
        }
      }


      // ______________ align strokes to given plane ______________

      Transform align = Transform.PlaneToPlane(Plane.WorldXY, P); // align transformation
      for(int j = 0; j < strokes.Count; j++){
        strokes[j].Transform(align);
      }

      C = strokes;
    }
# ---------- f_fpars: C# additional code ----------
  void initComp(){
    Component.Name = "Font Parser";
    Component.NickName = "f_FPars";
    Component.Description = "converts text into polylines - useful for fabrication \npair it with single-line fonts for best results";
    Component.Params.Input[0].Name = "String";
    Component.Params.Input[0].Description = "String of text to convert";
    Component.Params.Input[1].Name = "Text font";
    Component.Params.Input[1].Description = "text font\nsingle-line font is suggested for fabrication\ni.e. laser cutting";
    Component.Params.Input[2].Name = "Closed Polylines?";
    Component.Params.Input[2].Description = "Close polylines True/False(default)";
    Component.Params.Input[3].Name = "Text Size";
    Component.Params.Input[3].Description = "Text size in Rhino units";
    Component.Params.Input[4].Name = "Sampling Precision";
    Component.Params.Input[4].Description = "sampling precision\n(usually 100-250 is ok)";
    Component.Params.Input[5].Name = "Plane";
    Component.Params.Input[5].Description = "destination plane";
    Component.Params.Input[6].Name = "Justification";
    Component.Params.Input[6].Description = "text justification (0-8) - attach a value list for autovalues";

    Component.Params.Output[0].Name = "Curves";
    Component.Params.Output[0].Description = "Curves from text conversion";
  }
# ---------- end f_fpars ----------

# ---- group: proof of SLH triangle formula
number_slider_3 = Slider(4.867, range=1..10)
angle_4 = Slider(0.379, range=0..0.48)
pt_4 = Point(Point(0, 0, 0))
X_2 = UnitX(Factor=1)
Z_2 = UnitZ(Factor=1)
pi = Pi(Factor=1)
pi_2 = Pi(Factor=angle_4)
subtraction_4 = Subtraction(A=pi, B=pi_2)
expression = Expression(x=number_slider_3, y=pi_2, Expression="(x*0.5)/cos(y)")
vrot_2 = Rotate(Vector=X_2, Axis=Z_2, Angle=pi_2)
expression_2 = Expression(x=number_slider_3, y=pi_2, Expression="x*0.5*tan(y)")
vrot_3 = Rotate(Vector=X_2, Axis=Z_2, Angle=subtraction_4)
Y = UnitY(Factor=1)

# ---- group: proof of SLH triangle formula / L
line = LineSDL(Start=pt_4, Direction=X_2, Length=number_slider_3)

# ---- group: proof of SLH triangle formula (continued)
curvepoint = PointOnCurve(line, parameter=0.5)
end = EndPoints(Curve=line)  # -> Start, End

# ---- group: proof of SLH triangle formula / H
line_2 = LineSDL(Start=curvepoint, Direction=Y, Length=expression_2)

# ---- group: proof of SLH triangle formula / S
# S
# H
line_3 = LineSDL(Start=end.Start, Direction=vrot_2, Length=expression)
# a
# L
line_4 = LineSDL(Start=end.End, Direction=vrot_3, Length=expression)

# ==== cluster DoubleShift: Performs a double shift on a list - with optional wrap
list = ClusterInput()
# froGH - a sparse collection of (in)utilities for Grasshopper
# 
# Double Shift v 0.1
# code by Alessio Erioli
# 
#     froGH by Co-de-iT is licensed under a Creative Commons Attribution 4.0 International License.
#     http://creativecommons.org/licenses/by/4.0/
wrap = ClusterInput()  # enable-disable wrap behaviour
shift = ShiftList(List=list, Shift=1, Wrap=wrap)
shift_2 = ShiftList(List=list, Shift="-1", Wrap=wrap)
forward = ClusterOutput(shift_2)  # forward shifted list
backwards = ClusterOutput(shift)  # backwards shifted list
