# Grasshopper definition Mesh connectivity components.gh (Grasshopper 1.0.7)
# Copyright: Co-de-iT
# plug-ins: MeshEdit Components, Human, Weaverbird

srf = Surface(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)
mesh_uv = MeshSurface(Surface=srf, UCount=Slider(40, range=5..50), VCount=Slider(20, range=5..20), Overhang=True, Equalize=False)
weldvertices = MeshWeldVertices(Mesh=mesh_uv, Tolerance=0.01)  # -> RuntimeMessage, Mesh
wbcatmullclark = WeaverbirdsCatmullClarkSubdivision(MeshCurves=weldvertices.Mesh, Level=Slider(2, range=1..3), SmoothNakedEdges=1)
# <title>
# 
# <description>
# 
# code by Alessio Erioli
# 
# v 0.1
panel = Panel(wbcatmullclark)
vertex_index = Slider(100, range=0..100)
edge_index = Slider(43, range=0..100)
face_index = Slider(19, range=0..100)
mesh = Mesh(weldvertices.Mesh)

# ---- group: vertex proximity map
# vV - vertices
# vE - edges
# vF - faces
# 
# connected to each vertex
f_mc_vpm = MeshConnectivityVertexProximityMap(M=mesh)  # -> vV, vE, vF; inputs M: Mesh
# ---------- f_mc_vpm: C# usings ----------
using System.Threading.Tasks;
using System.Linq;
# ---------- f_mc_vpm: C# ----------
                                                         /*
    froGH - a sparse collection of (in)utilities for Grasshopper

    Mesh Connectivity - Vertex Proximity Map

    code by Alessio Erioli

    froGH by Co-de-iT is licensed under a Creative Commons Attribution 4.0 International License.
    http://creativecommons.org/licenses/by/4.0/

    */

    initComp();

    if (M == null) return;

    int[][] vertices = new int[M.Vertices.Count][];
    int[][] edges = new int[M.Vertices.Count][];
    int[][] faces = new int[M.Vertices.Count][];

    Parallel.For(0, M.Vertices.Count, i =>
      {

      // fill faces array
      faces[i] = M.Vertices.GetVertexFaces(i);

      // fill edges array
      edges[i] = M.TopologyVertices.ConnectedEdges(M.TopologyVertices.TopologyVertexIndex(i));


      // fill vertices array
      vertices[i] = M.Vertices.GetConnectedVertices(i);

      });

    vV = ToDataTree(vertices);
    vE = ToDataTree(edges);
    vF = ToDataTree(faces);
# ---------- f_mc_vpm: C# additional code ----------
  void initComp(){
    Component.Name = "Mesh Connectivity - Vertex Proximity Map";
    Component.NickName = "f_MC-VPM";
    Component.Description = "Mesh vertex-centered Topological connectivity map";
    Component.Params.Input[0].Name = "Mesh";
    Component.Params.Input[0].Description = "The Input Mesh";
    Component.Params.Output[0].Name = "Connected vertices";
    Component.Params.Output[0].Description = "Indexes of connected vertices to each vertex";
    Component.Params.Output[1].Name = "Connected edges";
    Component.Params.Output[1].Description = "Indexes of connected edges to each vertex";
    Component.Params.Output[2].Name = "Connected faces";
    Component.Params.Output[2].Description = "Indexes of connected vertices to each vertex";
  }

  public DataTree<GH_Integer> ToDataTree(int[][] array)
  {
    DataTree<GH_Integer> dt = new DataTree<GH_Integer>();
    for(int i = 0; i < array.Length;i++)
      dt.AddRange(array[i].Select(x => new GH_Integer(x)), new GH_Path(i));
    return dt;
  }
# ---------- end f_mc_vpm ----------

# ---- group: edge proximity map
# eV - vertices
# eE - edges
# eF - faces
# 
# connected to each edge
f_mc_epm = MeshConnectivityEdgeProximityMap(M=mesh)  # -> eV, eE, eF; inputs M: Mesh
# ---------- f_mc_epm: C# ----------
                                                                /*
    froGH - a sparse collection of (in)utilities for Grasshopper

    Mesh Connectivity - Edge Proximity Map

    code by Alessio Erioli

    froGH by Co-de-iT is licensed under a Creative Commons Attribution 4.0 International License.
    http://creativecommons.org/licenses/by/4.0/

    */

    initComp();

    if (M == null) return;

    int[][] vertices = new int[M.TopologyEdges.Count][];
    int[][][] edges = new int[M.TopologyEdges.Count][][];
    int[][] faces = new int[M.TopologyEdges.Count][];

    Parallel.For(0, M.TopologyEdges.Count, i =>
      //for (int i = 0; i < M.TopologyEdges.Count; i++)
      {
      int[] edgeEndPts = new int[2];

      // fill faces array
      faces[i] = M.TopologyEdges.GetConnectedFaces(i);


      // fill edges array

      // topology edge > index of vertices at endpoints
      edgeEndPts[0] = M.TopologyEdges.GetTopologyVertices(i).I;
      edgeEndPts[1] = M.TopologyEdges.GetTopologyVertices(i).J;

      edges[i] = new int[2][];

      // get connected edges at each endpoint
      for(int j = 0; j < edgeEndPts.Length; j++)
      {
        HashSet<int> connV = new HashSet<int>();
        int[] coV = M.TopologyVertices.ConnectedEdges(edgeEndPts[j]);
        foreach (int v in coV)
          connV.Add(v);
        connV.Remove(i);
        edges[i][j] = connV.ToArray();
      }

      // fill vertices array
      vertices[i] = new int[2];
      vertices[i][0] = M.TopologyVertices.MeshVertexIndices(edgeEndPts[0])[0];
      vertices[i][1] = M.TopologyVertices.MeshVertexIndices(edgeEndPts[1])[0];

      });

    eV = ToDataTree(vertices);
    eE = ToDataTree(edges);
    eF = ToDataTree(faces);
# ---------- f_mc_epm: C# additional code ----------
  void initComp(){
    Component.Name = "Mesh Connectivity - Edge Proximity Map";
    Component.NickName = "f_MC-EPM";
    Component.Description = "Mesh edge-centered Topological connectivity map";
    Component.Params.Input[0].Name = "Mesh";
    Component.Params.Input[0].Description = "The Input Mesh";
    Component.Params.Output[0].Name = "Connected vertices";
    Component.Params.Output[0].Description = "Indexes of endpoint vertices of each edge";
    Component.Params.Output[1].Name = "Connected edges";
    Component.Params.Output[1].Description = "Indexes of connected edges to each edge";
    Component.Params.Output[2].Name = "Connected faces";
    Component.Params.Output[2].Description = "Indexes of faces shared by each edge";
  }

  public DataTree<GH_Integer> ToDataTree(int[][] array)
  {
    DataTree<GH_Integer> dt = new DataTree<GH_Integer>();
    for(int i = 0; i < array.Length;i++)
      dt.AddRange(array[i].Select(x => new GH_Integer(x)), new GH_Path(i));
    return dt;
  }

  public DataTree<GH_Integer> ToDataTree(int[][][] array)
  {
    DataTree<GH_Integer> dt = new DataTree<GH_Integer>();
    for(int i = 0; i < array.Length;i++)
      for(int j = 0; j < array[i].Length; j++)
        dt.AddRange(array[i][j].Select(x => new GH_Integer(x)), new GH_Path(i, j));
    return dt;
  }
# ---------- end f_mc_epm ----------

# ---- group: vertex proximity - single
f_mc_vpm_2 = MeshConnectivityVertexProximitySingle(M=mesh, i=vertex_index)  # -> vV, vE, vF; inputs M: Mesh, i: Int32
# ---------- f_mc_vpm_2: C# usings ----------
using System.Linq;
# ---------- f_mc_vpm_2: C# ----------
                                                                /*
    froGH - a sparse collection of (in)utilities for Grasshopper

    Mesh Connectivity - Vertex Proximity Map

    code by Alessio Erioli

    froGH by Co-de-iT is licensed under a Creative Commons Attribution 4.0 International License.
    http://creativecommons.org/licenses/by/4.0/

    */

    initComp();
   
    if (M == null) return;
    i = i % M.Vertices.Count;
    int[] vertices;
    int[] edges;
    int[] faces;

    // fill faces data tree
    faces = M.Vertices.GetVertexFaces(i);  //.Select(x => new GH_Integer(x));

    // fill edges data tree
    edges = M.TopologyVertices.ConnectedEdges(M.TopologyVertices.TopologyVertexIndex(i));//.Select(x => new GH_Integer(x));


    // fill vertices data tree
    vertices = M.Vertices.GetConnectedVertices(i);//.Select(x => new GH_Integer(x));

    vV = vertices;
    vE = edges;
    vF = faces;
# ---------- f_mc_vpm_2: C# additional code ----------
  void initComp(){
    Component.Name = "Mesh Connectivity - Vertex Proximity Single";
    Component.NickName = "f_MC-VPM";
    Component.Description = "Mesh vertex-centered Topological connectivity map";
    Component.Params.Input[0].Name = "Mesh";
    Component.Params.Input[0].Description = "The Input Mesh";
    Component.Params.Input[1].Name = "index";
    Component.Params.Input[1].Description = "The vertex index";
    Component.Params.Output[0].Name = "Connected vertices";
    Component.Params.Output[0].Description = "Indexes of connected vertices to this vertex";
    Component.Params.Output[1].Name = "Connected edges";
    Component.Params.Output[1].Description = "Indexes of connected edges to this vertex";
    Component.Params.Output[2].Name = "Connected faces";
    Component.Params.Output[2].Description = "Indexes of connected vertices to this vertex";
  }
# ---------- end f_mc_vpm_2 ----------

# ---- group: face proximity map
# fV - vertices
# fE - edges
# fF - faces
# 
# connected to each face
f_mc_fpm = MeshConnectivityFaceProximityMap(M=mesh)  # -> fV, fE, fF; inputs M: Mesh
# ---------- f_mc_fpm: C# ----------
                                                                       /*
    froGH - a sparse collection of (in)utilities for Grasshopper

    Mesh Connectivity - Face Proximity Map

    code by Alessio Erioli

    froGH by Co-de-iT is licensed under a Creative Commons Attribution 4.0 International License.
    http://creativecommons.org/licenses/by/4.0/

    */

    initComp();

    if (M == null) return;

    int[][] vertices = new int[M.Faces.Count][];
    int[][] edges = new int[M.Faces.Count][];
    int[][] faces = new int[M.Faces.Count][];

    Parallel.For(0, M.Faces.Count, i =>
      {

      // fill faces array

      faces[i] = M.Faces.AdjacentFaces(i);

      // fill edges array

      edges[i] = M.TopologyEdges.GetEdgesForFace(i);

      // fill vertices array

      if(M.Faces[i].IsQuad)
      {
        vertices[i] = new int[4];
        vertices[i][0] = M.Faces[i].A;
        vertices[i][1] = M.Faces[i].B;
        vertices[i][2] = M.Faces[i].C;
        vertices[i][3] = M.Faces[i].D;
      } else
      {
        vertices[i] = new int[3];
        vertices[i][0] = M.Faces[i].A;
        vertices[i][1] = M.Faces[i].B;
        vertices[i][2] = M.Faces[i].C;
      }
      });

    fV = ToDataTree(vertices);
    fE = ToDataTree(edges);
    fF = ToDataTree(faces);
# ---------- f_mc_fpm: C# additional code ----------
  void initComp(){
    Component.Name = "Mesh Connectivity - Face Proximity Map";
    Component.NickName = "f_MC-FPM";
    Component.Description = "Mesh face-centered Topological connectivity map";
    Component.Params.Input[0].Name = "Mesh";
    Component.Params.Input[0].Description = "The Input Mesh";
    Component.Params.Output[0].Name = "Connected vertices";
    Component.Params.Output[0].Description = "Indexes of each face's vertices";
    Component.Params.Output[1].Name = "Connected edges";
    Component.Params.Output[1].Description = "Indexes of each face's edges";
    Component.Params.Output[2].Name = "Connected faces";
    Component.Params.Output[2].Description = "Indexes of connected faces for each face";
  }

  public DataTree<GH_Integer> ToDataTree(int[][] array)
  {
    DataTree<GH_Integer> dt = new DataTree<GH_Integer>();
    for(int i = 0; i < array.Length;i++)
      dt.AddRange(array[i].Select(x => new GH_Integer(x)), new GH_Path(i));
    return dt;
  }
# ---------- end f_mc_fpm ----------

# ---- group: edge proximity - single
f_mc_eps = MeshConnectivityEdgeProximitySingle(M=mesh, i=edge_index)  # -> eV, eE, eF; inputs M: Mesh, i: Int32
# ---------- f_mc_eps: C# ----------
        /*
    froGH - a sparse collection of (in)utilities for Grasshopper

    Mesh Connectivity - Edge Proximity Map

    code by Alessio Erioli

    froGH by Co-de-iT is licensed under a Creative Commons Attribution 4.0 International License.
    http://creativecommons.org/licenses/by/4.0/

    */

    initComp();

    if (M == null) return;

    i = i % M.TopologyEdges.Count;

    int[] vertices;// = new DataTree<GH_Integer>();
    DataTree<int> edges = new DataTree<int>();
    int[] faces;// = new DataTree<GH_Integer>();

    // fill faces data tree
    faces = M.TopologyEdges.GetConnectedFaces(i);//.Select(x => new GH_Integer(x)), p);


    // fill vertices data tree
    vertices = new int[2];

    // topology edge > index of vertices at endpoints
    vertices[0] = M.TopologyEdges.GetTopologyVertices(i).I;
    vertices[1] = M.TopologyEdges.GetTopologyVertices(i).J;

    // fill edges data tree
    // get connected edges at each endpoint
    for(int j = 0; j < vertices.Length; j++)
    {
      HashSet<int> connV = new HashSet<int>();
      int[] coV = M.TopologyVertices.ConnectedEdges(vertices[j]);
      foreach (int v in coV)
        connV.Add(v);
      connV.Remove(i);
      edges.AddRange(connV, new GH_Path(i, j));
    }


    eV = vertices;
    eE = edges;
    eF = faces;
# ---------- f_mc_eps: C# additional code ----------
  void initComp(){
    Component.Name = "Mesh Connectivity - Edge Proximity Single";
    Component.NickName = "f_MC-EPS";
    Component.Description = "Mesh Topological connectivity for a single edge";
    Component.Params.Input[0].Name = "Mesh";
    Component.Params.Input[0].Description = "The Input Mesh";
    Component.Params.Input[1].Name = "index";
    Component.Params.Input[1].Description = "The edge index";
    Component.Params.Output[0].Name = "Connected vertices";
    Component.Params.Output[0].Description = "Indexes of endpoint vertices for this edge";
    Component.Params.Output[1].Name = "Connected edges";
    Component.Params.Output[1].Description = "Indexes of connected edges to this edge";
    Component.Params.Output[2].Name = "Connected faces";
    Component.Params.Output[2].Description = "Indexes of faces shared by this edge";
  }
# ---------- end f_mc_eps ----------

# ---- group: face proximity - single
f_mc_fps = MeshConnectivityFaceProximitySingle(M=mesh, i=face_index)  # -> fV, fE, fF; inputs M: Mesh, i: Int32
# ---------- f_mc_fps: C# ----------
                                                                          /*
    froGH - a sparse collection of (in)utilities for Grasshopper

    Mesh Connectivity - Face Proximity Single

    code by Alessio Erioli

    froGH by Co-de-iT is licensed under a Creative Commons Attribution 4.0 International License.
    http://creativecommons.org/licenses/by/4.0/

    */

    initComp();

    if (M == null) return;

    i = i % M.Faces.Count;

    int[] vertices;// = new DataTree<GH_Integer>();
    int[] edges;// = new DataTree<GH_Integer>();
    int[] faces;// = new DataTree<GH_Integer>();

    // fill faces array
    faces = M.Faces.AdjacentFaces(i);


    // fill edges array
    edges = M.TopologyEdges.GetEdgesForFace(i);


    // fill vertices array
    if(M.Faces[i].IsQuad)
    {
      vertices = new int[4];
      vertices[0] = M.Faces[i].A;
      vertices[1] = M.Faces[i].B;
      vertices[2] = M.Faces[i].C;
      vertices[3] = M.Faces[i].D;
    }else
    {
      vertices = new int[3];
      vertices[0] = M.Faces[i].A;
      vertices[1] = M.Faces[i].B;
      vertices[2] = M.Faces[i].C;
    }


    fV = vertices;
    fE = edges;
    fF = faces;
# ---------- f_mc_fps: C# additional code ----------
  void initComp(){
    Component.Name = "Mesh Connectivity - Face Proximity Single";
    Component.NickName = "f_MC-FPS";
    Component.Description = "Mesh Topological connectivity for a single face";
    Component.Params.Input[0].Name = "Mesh";
    Component.Params.Input[0].Description = "The Input Mesh";
    Component.Params.Input[1].Name = "index";
    Component.Params.Input[1].Description = "The face index";
    Component.Params.Output[0].Name = "Connected vertices";
    Component.Params.Output[0].Description = "Indexes of the face's vertices";
    Component.Params.Output[1].Name = "Connected edges";
    Component.Params.Output[1].Description = "Indexes of the face's edges";
    Component.Params.Output[2].Name = "Connected faces";
    Component.Params.Output[2].Description = "Indexes of connected faces to this face";
  }
# ---------- end f_mc_fps ----------

# ----
# eE separates edges connected to each edge endpoint in 2 sub-branches
viewer = ParamViewer(f_mc_epm.eE)

# ---- group: extract mesh edges as list
c_script = CSharpScript(M=mesh)  # -> mE; inputs M: Mesh
# ---------- c_script: C# usings ----------
using System.Threading.Tasks;
# ---------- c_script: C# ----------
    GH_Line[] eLines = new GH_Line[M.TopologyEdges.Count];
    
    Parallel.For(0, M.TopologyEdges.Count, i =>
      {
      eLines[i] = new GH_Line(M.TopologyEdges.EdgeLine(i));
      });
    
    mE = eLines;
# ---------- end c_script ----------

# ----
percent = Slider(0.387, range=0..1)
lng = ListLength(List=c_script)  # -> expr("x-1", Length)
multiplication = Multiplication(A=lng, B=percent)
int = Integer(multiplication)
pshift = ShiftPaths(Data=f_mc_epm.eE, Offset=-1)

demesh = DeconstructMesh(Mesh=mesh)  # -> Vertices, Faces, Colours, Normals; disabled
number_slider = Slider(0.5, range=0..1)  # disabled
facen = FaceNormals(Mesh=mesh)  # -> Centers, Normals; disabled
number_slider_2 = Slider(0.35, range=0..1)  # disabled
number_slider_3 = Slider(0.25, range=0..1)  # disabled
ilist = IndexesFromList(D=demesh.Vertices)  # -> i; inputs D: list; disabled
# ---------- ilist: C# ----------
    GH_Integer[] indexes = new GH_Integer[D.Count];

    for(int j = 0; j < D.Count; j++)
      indexes[j] = new GH_Integer(j);

    //A = indexes.Sum(j => j.Value); // uses System.Linq Sum selector function - for each GH_Integer j in indexes add its value to the total sum
    
    i = indexes;
# ---------- end ilist ----------
curvepoint = PointOnCurve(c_script, parameter=0.5)  # disabled
swatch = ColourSwatch(SwatchColor=RGB(255, 255, 255))  # disabled
swatch_2 = ColourSwatch(SwatchColor=RGB(0, 0, 0))  # disabled
ilist_2 = IndexesFromList(D=facen.Centers)  # -> i; inputs D: list; disabled; same code as ilist
ilist_3 = IndexesFromList(D=c_script)  # -> i; inputs D: list; disabled; same code as ilist
swatch_3 = ColourSwatch(SwatchColor=RGB(255, 170, 0))  # disabled
tag = TextTag3D(Location=curvepoint, Text=ilist_3, Size=number_slider_3, Colour=swatch, Justification=5)  # disabled
tag_2 = TextTag3D(Location=demesh.Vertices, Text=ilist, Size=number_slider, Colour=swatch_2, Justification=5)  # disabled
tag_3 = TextTag3D(Location=facen.Centers, Text=ilist_2, Size=number_slider_2, Colour=swatch_3, Justification=5)  # disabled

panel_2 = Panel(int)
branch = TreeBranch(Tree=pshift, Path=int, MaintainPaths=True)
item = ListItem(List=c_script, Index=int, Wrap=True)
item_2 = ListItem(List=c_script, Index=branch, Wrap=True)
previewlw = CustomPreviewLineweights(Geometry=item, Shader=ColourSwatch(SwatchColor=RGB(255, 0, 225)), Thickness="5", Absolute=False)
previewlw_2 = CustomPreviewLineweights(Geometry=item_2, Shader=ColourSwatch(SwatchColor=RGB(255, 255, 255)), Thickness="3", Absolute=False)
