# Grasshopper definition Mesh isocurve.gh (Grasshopper 1.0.7)
# Copyright: Co-de-iT
# plug-ins: FileToScript, Human, Weaverbird, Noise 4D

sub_folder = Panel("froGH")
file_name_extension = Panel("Mesh Isocurve.cs")
dir_type = ValueList({"desktop": 0, "documents": 1, "GH file path": 2, "C:": 3}, selected="GH file path")
f_pathg = PathGenerator(type=dir_type, subDir=sub_folder)  # -> dir; inputs type: Int32, subDir: String
# ---------- f_pathg: C# ----------
                           /*
    froGH - a sparse collection of (in)utilities for Grasshopper

    Path Generator
    code by Alessio Erioli - value list generation based on code by James Ramsden

    froGH by Co-de-iT is licensed under a Creative Commons Attribution 4.0 International License.
    http://creativecommons.org/licenses/by/4.0/

    */
    initComp();


    String S = "";
    String root = "";
    String end = "\\";
    String eol = Environment.NewLine;

    // __________________ autoList part __________________

    // variable for the list
    Grasshopper.Kernel.Special.GH_ValueList vList;
    // tries to cast input as list
    try{

      // if the list is not the first parameter then change Input[0] to the corresponding value
      vList = (Grasshopper.Kernel.Special.GH_ValueList) Component.Params.Input[0].Sources[0];
      // Print("value list connected");
      // check if the list must be created
      //if (vList.NickName != "dir type"){
      if (!vList.NickName.Equals("dir type")){
        vList.ClearData();
        vList.ListItems.Clear();
        vList.NickName = "dir type";
        var item1 = new Grasshopper.Kernel.Special.GH_ValueListItem("desktop", "0");
        var item2 = new Grasshopper.Kernel.Special.GH_ValueListItem("documents", "1");
        var item3 = new Grasshopper.Kernel.Special.GH_ValueListItem("GH file path", "2");
        var item4 = new Grasshopper.Kernel.Special.GH_ValueListItem("C:", "3");
        vList.ListItems.Add(item1);
        vList.ListItems.Add(item2);
        vList.ListItems.Add(item3);
        vList.ListItems.Add(item4);

        vList.ListItems[0].Value.CastTo(out type);
      }
    }
    catch{
      // handles anything that is not a value list
    }


    switch(type){
      case 0:
        root = Environment.GetFolderPath(Environment.SpecialFolder.Desktop) + end;
        S = "Desktop";
        break;
      case 1:
        root = Environment.GetFolderPath(Environment.SpecialFolder.MyDocuments) + end;
        S = "Documents";
        break;
      case 2:
        GH_Document ghDoc = owner.OnPingDocument();

        if (ghDoc.IsFilePathDefined)
        {
          int nameLen = ghDoc.DisplayName.TrimEnd('*').Length + 3; // +3 accounts for the '.gh' extension
          int fileLen = ghDoc.FilePath.TrimEnd('*').Length;

          //F = ghDoc.DisplayName.TrimEnd('*');
          root = ghDoc.FilePath.Substring(0, fileLen - nameLen);
          //root = gh_d.FilePath;
          S = "GH File path";
        }
        else
        {
          Print("No path defined. Saving to Desktop until then");
          root = Environment.GetFolderPath(Environment.SpecialFolder.Desktop);
          S = "Desktop";
        }
        break;
      case 3:
        root = "C:" + end;
        S = root + end;
        break;
    }
    dir = root + (subDir != null ? (subDir + end) : "");
    Component.Message = S;
# ---------- f_pathg: C# additional code ----------
  void initComp(){
    Component.Name = "Path Generator";
    Component.NickName = "f_PathG";
    Component.Description = "generates a path based on local direcories such as Desktop, Documents, GH file path";
    Component.Params.Input[0].Name = "dir type";
    Component.Params.Input[0].Description = "directory type: 0 desktop, 1 documents, 2 GH file path, 3 C:\nconnect a value list for automatic list generation";
    Component.Params.Input[1].Name = "custom subdir";
    Component.Params.Input[1].Description = "(optional) custom subdirectory";
  }
# ---------- end f_pathg ----------
concat = Concatenate(FragmentA=f_pathg, FragmentB=file_name_extension)
path = FilePath(concat)
mesh = Mesh(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)
wbcatmullclark = WeaverbirdsCatmullClarkSubdivision(MeshCurves=mesh, Level=Slider(3, range=1..3), SmoothNakedEdges=2)
msphere = MeshSphere(Base=PlaneXY(0, 0, 0), Radius=10, UCount=10, VCount=20)

# ---- group: animate noise
number_slider = Slider(0.015, range=0..10)
reset = Button()
go = BooleanToggle(False)

# ----
mesh_2 = Mesh(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)
wbcatmullclark_2 = WeaverbirdsCatmullClarkSubdivision(MeshCurves=wbcatmullclark, Level="1", SmoothNakedEdges=2)

# ---- group: animate noise
c_script = CSharpScript(reset=reset, go=go, increment=number_slider)  # -> out, A; inputs reset: Boolean, go: Boolean, increment: Double
# ---------- c_script: C# ----------
    if (reset) i = 0;
    if (go)
    {
      i ++;
      Component.ExpireSolution(true);
    }
    A = i*increment;
# ---------- c_script: C# additional code ----------
  int i;
# ---------- end c_script ----------

# ----
c_script_2 = CSharpScript(M=wbcatmullclark_2)  # -> out, A; inputs M: Mesh
# ---------- c_script_2: C# ----------
    List < GH_Line > els = new List<GH_Line>();
    for(int i = 0; i < M.TopologyEdges.Count; i++) els.Add(new GH_Line(M.TopologyEdges.EdgeLine(i)));
    A = els;
    //string s = "0001";
    //A = Convert.ToInt32(s, 2); //convert to binary system
    //
# ---------- end c_script_2 ----------
demesh = DeconstructMesh(Mesh=wbcatmullclark_2)  # -> Vertices, Faces, Colours, Normals
simplex = SimplexNoise(Values=demesh.Vertices, Time=c_script.A, Scale=Slider(0.04, range=0..1))
gradient = Gradient(LowerLimit="-1", UpperLimit=1, Parameter=simplex, stops=[0: RGB(0, 0, 0), 1: RGB(255, 255, 255)])
# © Co-de-iT 2020 / Creative Commons Attribution-Non Commercial-ShareAlike 4.0 International License
number_slider_2 = Slider(30, range=1..30)
conmesh = ConstructMesh(Vertices=demesh.Vertices, Faces=demesh.Faces, Colours=gradient)
# <title>
# 
# <description>
# 
# code by Alessio Erioli
# 
# v 0.1
number_slider_3 = Slider(0, range=0..2)
range = Range(Domain=Domain(0, 1), Steps=number_slider_2)

# ---- group: old version (has minor bugs)
c_script_3 = CSharpScript()  # -> out, isoCurve; inputs M: Mesh, channel: Int32, iso: Double; disabled
# ---------- c_script_3: C# usings ----------
using System.Drawing;
using System.Threading;
using System.Threading.Tasks;
using System.Collections.Concurrent;
# ---------- c_script_3: C# ----------
        // return on null, if Mesh has no colors or if not all faces are quads
        if (M == null) return;
        if (M.VertexColors.Count == 0)
        {
            Component.AddRuntimeMessage(GH_RuntimeMessageLevel.Error, "Mesh must have vertex colors");
            return;
        }
        //    {
        //      Print("Please use a Mesh with vertex colors");
        //      return;
        //    }
        if (M.Faces.QuadCount < M.Faces.Count)
        {
            Component.AddRuntimeMessage(GH_RuntimeMessageLevel.Error, "Mesh must have only quad faces");
            return;
        }

        // sorts vertices and normalized color values by face
        Point3d[,] VerticesByFace = new Point3d[M.Faces.Count, 4];
        double[,] ValuesByFace = new double[M.Faces.Count, 4];
        bool[,] IsNaked = new bool[M.Faces.Count, 4];
        bool[] NakedStatus = M.GetNakedEdgePointStatus();
        DataTree<Line> LineSegments = new DataTree<Line>();

        Line[][] LineSegmentsArray = new Line[M.Faces.Count][];

        //ConcurrentBag<Line> LineSegParallel = new ConcurrentBag<Line>();

        DataTree<Point3d> FoundPts = new DataTree<Point3d>();

        Parallel.For(0, M.Faces.Count, i =>
        //for (int i = 0; i < M.Faces.Count; i++)
        {
            int[] ind = new int[4];

            ind[0] = M.Faces[i].A;
            ind[1] = M.Faces[i].B;
            ind[2] = M.Faces[i].C;
            ind[3] = M.Faces[i].D;

            for (int j = 0; j < 4; j++)
            {
              // store face vertices
              VerticesByFace[i, j] = (Point3d)M.Vertices[ind[j]];
              // store naked status
              IsNaked[i, j] = NakedStatus[ind[j]];

              // store corresponding normalized color values
              Color c = M.VertexColors[ind[j]];
                switch (channel)
                {
                    case 0:
                        ValuesByFace[i, j] = c.R / 255.0;
                        break;
                    case 1:
                        ValuesByFace[i, j] = c.G / 255.0;
                        break;
                    case 2:
                        ValuesByFace[i, j] = c.B / 255.0;
                        break;
                }
            }
        });

        Parallel.For(0, M.Faces.Count, i =>
        //for (int i = 0; i < M.Faces.Count; i++)
        {
            Line lin;
            List<Line> FaceLines = new List<Line>();
          // check and eventually store line segments
          // contains found points per face
          List<Point3d> Pts = new List<Point3d>();

            for (int j = 0; j < 4; j++)
            {
              // make index circular
              int jp1 = (j + 1) % 4;

              // store naked edge status
              bool isEdgeNaked = IsNaked[i, j] && IsNaked[i, jp1];

              // create an interval between j and j+1 values
              Interval Inter = new Interval(ValuesByFace[i, j], ValuesByFace[i, jp1]);

              // check if iso value is included
              if (Inter.IncludesParameter(iso))
                {
                  // if interval is not collapsed
                  if (Inter.Length != 0)
                    {
                        double t = (iso - Inter.T0) / Inter.Length;
                        Point3d Point = VerticesByFace[i, j] + (VerticesByFace[i, jp1] - VerticesByFace[i, j]) * t;
                        Pts.Add(Point);
                      //FoundPts.Add(Point, new GH_Path(i));
                      // if one of these vertices is a naked one store also the line
                      // between Point and the naked vertex...
                      if (IsNaked[i, j] && IsNaked[i, jp1])
                        {
                          // ...in the direction of the highest interval value
                          if (Inter.Length < 0)
                            {
                                lin = new Line(VerticesByFace[i, j], Point);
                              //LineSegments.Add(lin, new GH_Path(i));
                              FaceLines.Add(lin);
                            }
                            else
                            {
                                lin = new Line(Point, VerticesByFace[i, jp1]);
                              //LineSegments.Add(lin, new GH_Path(i));
                              FaceLines.Add(lin);
                            }
                        }
                    }
                }
              // if iso value is not in interval either both vertices are above or below iso
              // if both are above and edge is naked include entire segment
              else if (ValuesByFace[i, j] > iso && ValuesByFace[i, jp1] > iso && isEdgeNaked)
                {
                    lin = new Line(VerticesByFace[i, j], VerticesByFace[i, jp1]);
                  //LineSegments.Add(lin, new GH_Path(i));
                  FaceLines.Add(lin);
                }
              // if both values are below iso do nothing
          }


            switch (Pts.Count)
            {
                case 2:
                    lin = new Line(Pts[0], Pts[1]);
                  //LineSegments.Add(lin, new GH_Path(i));
                  FaceLines.Add(lin);
                    break;
                case 3:
                  // one coincident point - if it's not 0 or 1 it should be 2...
                  if (IsPointDuplicate(Pts[0], Pts[1], 0.0001))
                    {
                        lin = new Line(Pts[0], Pts[2]);
                      //LineSegments.Add(lin, new GH_Path(i));
                      FaceLines.Add(lin);
                    }
                    else if (IsPointDuplicate(Pts[1], Pts[2], 0.0001))
                    {
                        lin = new Line(Pts[0], Pts[1]);
                      //LineSegments.Add(lin, new GH_Path(i));
                      FaceLines.Add(lin);
                      //Print("{0}", i);
                  }
                    else if (IsPointDuplicate(Pts[0], Pts[2], 0.0001))
                    {
                        lin = new Line(Pts[1], Pts[2]);
                      //LineSegments.Add(lin, new GH_Path(i));
                      FaceLines.Add(lin);

                    }
                    else // no coincident points
                  {
                        lin = new Line(Pts[0], Pts[1]);
                        FaceLines.Add(lin);
                        lin = new Line(Pts[1], Pts[2]);
                        FaceLines.Add(lin);

                    }
                    break;
                case 4:
                  // 4 points - if there are no coincident points...
                  if (IsPointDuplicate(Pts[0], Pts[1], 0.0001) || IsPointDuplicate(Pts[0], Pts[3], 0.0001))
                    {
                        lin = new Line(Pts[0], Pts[2]);
                      //LineSegments.Add(lin, new GH_Path(i));
                      FaceLines.Add(lin);
                    }
                  // there are 2 possible combinations
                  if (ValuesByFace[i, 0] > ValuesByFace[i, 1])
                    {
                        lin = new Line(Pts[0], Pts[1]);
                      //LineSegments.Add(lin, new GH_Path(i));
                      FaceLines.Add(lin);
                        lin = new Line(Pts[2], Pts[3]);
                      //LineSegments.Add(lin, new GH_Path(i));
                      FaceLines.Add(lin);
                    }
                    else
                    {
                        lin = new Line(Pts[0], Pts[3]);
                      //LineSegments.Add(lin, new GH_Path(i));
                      FaceLines.Add(lin);
                        lin = new Line(Pts[1], Pts[2]);
                      //LineSegments.Add(lin, new GH_Path(i));
                      FaceLines.Add(lin);
                    }
                    break;
            }
            LineSegmentsArray[i] = FaceLines.ToArray();
        });

        // List<Line> parallels = new List<Line>(LineSegParallel.ToArray());
        //isoCurve = ToPolylines(CullDuplicateLines(LineSegments.AllData()));
        //isoCurve = ToPolylines(CullDuplicateLines(parallels));
        //isoCurve = ToPolylines(CullDuplicateLines(ToLineList(LineSegmentsArray)));
        isoCurve = ToLineList(LineSegmentsArray);


        //A = ToDataTree(ValuesByFace);
        //A = FoundPts;
        //B = LineSegments.AllData();
        //B = ToLineList(LineSegmentsArray);
# ---------- c_script_3: C# additional code ----------
 

    DataTree<double> ToDataTree(double[,] DataArray)
    {
        DataTree<double> values = new DataTree<double>();
        for (int i = 0; i < DataArray.GetLength(0); i++)
            for (int j = 0; j < DataArray.GetLength(1); j++)
                values.Add(DataArray[i, j], new GH_Path(i));
        return values;
    }

    Curve[] ToPolylines(List<Line> L)
    {
        List<LineCurve> Lc = new List<LineCurve>();
        foreach (Line l in L) Lc.Add(new LineCurve(l));
        return Curve.JoinCurves(Lc);
    }

    List<GH_Line> ToLineList(Line[][] LineJaggedArray)
    {
        List<GH_Line> lines = new List<GH_Line>();
        for (int i = 0; i < LineJaggedArray.Length; i++)
            for (int j = 0; j < LineJaggedArray[i].Length; j++)
                lines.Add(new GH_Line(LineJaggedArray[i][j]));
        return lines;
    }

    List<Line> CullDuplicateLines(List<Line> L)
    {
        List<int> removeIndex = new List<int>();
        for (int i = 0; i < L.Count; i++)
            for (int j = i + 1; j < L.Count; j++)
            {
                if (IsLineDuplicate(L[i], L[j]))
                {
                    removeIndex.Add(i);
                    break;
                }
            }

        for (int i = removeIndex.Count - 1; i >= 0; i--)
            L.RemoveAt(removeIndex[i]);

        return L;
    }

    bool IsPointDuplicate(Point3d pA, Point3d pB, double tol)
    {
        return (pA.X - pB.X < tol && pA.Y - pB.Y < tol && pA.Z - pB.Z < tol);
    }

    bool IsLineDuplicate(Line l1, Line l2)
    {
        bool isDup = false;
        if ((l1.From == l2.From && l1.To == l2.To) || (l1.From == l2.To && l1.To == l2.From))
            isDup = true;
        return isDup;
    }
# ---------- end c_script_3 ----------

# ---- group: Marching squares
f_miso = MeshIsoCurve(M=conmesh, ch=number_slider_3, iso=range)  # -> C; inputs M: Mesh, ch: Int32, iso: Double
# ---------- f_miso: C# usings ----------
using System.Drawing;
using System.Threading.Tasks;
# ---------- f_miso: C# ----------
        /*
        froGH - a sparse collection of (in)utilities for Grasshopper

        Mesh IsoCurves
        an interpretation of the marching squares algorithm to get isocurves on a quad mesh

        code by Alessio Erioli

        froGH by Co-de-iT is licensed under a Creative Commons Attribution 4.0 International License.
        http://creativecommons.org/licenses/by/4.0/

        */

        initComp();

        // return on null
        if (M == null) return;
        // if Mesh has no colors or if not all faces are quads throw an error
        if (M.VertexColors.Count == 0)
        {
            Component.AddRuntimeMessage(GH_RuntimeMessageLevel.Error, "Mesh must have vertex colors");
            return;
        }

        if (M.Faces.QuadCount < M.Faces.Count)
        {
            Component.AddRuntimeMessage(GH_RuntimeMessageLevel.Error, "Mesh must have only quad faces");
            return;
        }

        C = ToLineList(isoCurvesOnColoredMesh(M, ch, iso));
# ---------- f_miso: C# additional code ----------
 

    // constants and LUTs
    private readonly int[] vPowers = new int[] { 8, 4, 2, 1 }; // from MSB (Most Significant Bit) to LSB (Least Significant Bit)
    // table of cases (1 to 14, case 0 and 15 leave the face empty)
    // cases are the indexes of the connected edges (see Marching Squares algorithm)
    private readonly int[][] cases = new int[][] { new int[] { 2, 3 }, new int[] { 1, 2 }, new int[] { 1, 3 }, new int[] { 0, 1 }, new int[] { 0,1,2,3 }, new int[] { 0, 2}, new int[] { 0, 3 },
        new int[] { 0, 3 }, new int[] { 0 , 2 }, new int[] { 0, 1, 2, 3 }, new int[] { 0 , 1 }, new int[] { 1, 3 }, new int[] { 1, 2 }, new int[] { 2, 3 }};


    void initComp()
    {
        Component.Name = "Mesh isoCurve";
        Component.NickName = "f_MIso";
        Component.Description = "Generates isocurves on colored quad meshes";
        Component.Params.Input[0].Name = "Mesh";
        Component.Params.Input[0].Description = "The colored quad Mesh";
        Component.Params.Input[1].Name = "Channel";
        Component.Params.Input[1].Description = "The color channel to use: 0-R, 1-G, 2-B";
        Component.Params.Input[2].Name = "Isovalue";
        Component.Params.Input[2].Description = "The isovalue to search for (0-1)";
        Component.Params.Output[0].Name = "Curves";
        Component.Params.Output[0].Description = "Isovalue Curves as line segments";
    }

    Line[][] isoCurvesOnColoredMesh(Mesh M, int channel, double iso)
    {
        // Variables
        bool[] nakedStatus = M.GetNakedEdgePointStatus();
        int[] isoStatus = new int[M.Vertices.Count];
        double[] normVValues = new double[M.Vertices.Count];


        // compile vertices values and status
        Parallel.For(0, M.Vertices.Count, i =>
        {
            // store normalized color values per vertex
            Color c = M.VertexColors[i];
            switch (channel)
            {
                case 0:
                    normVValues[i] = c.R / 255.0;
                    break;
                case 1:
                    normVValues[i] = c.G / 255.0;
                    break;
                case 2:
                    normVValues[i] = c.B / 255.0;
                    break;
                default:
                    goto case 1;
            }
            // find vertex iso status (0 = below iso, 1 = above iso)
            isoStatus[i] = Convert.ToInt32(normVValues[i] > iso);

        });

        //DataTree<Line> LineSegments = new DataTree<Line>();
        Line[][] LineSegmentsArray = new Line[M.Faces.Count][];

        // Performing algorithm
        Parallel.For(0, M.Faces.Count, i =>
        //for (int i = 0; i < M.Faces.Count; i++)
        {

            //List<Line> faceIsolines = new List<Line>();

            // Vertices indexes by face
            int[] ind = new int[4];

            ind[0] = M.Faces[i].A;
            ind[1] = M.Faces[i].B;
            ind[2] = M.Faces[i].C;
            ind[3] = M.Faces[i].D;

            // find face case
            int caseIndex = 0; // marching squares case
            for (int j = 0; j < 4; j++)
                caseIndex += vPowers[j] * isoStatus[ind[j]];

            //caseIndexes[i] = caseIndex;
            if (caseIndex > 0 && caseIndex < 15) // excluding null cases
            {
                // if in a saddle case.... 
                if (caseIndex == 5 || caseIndex == 10)
                {
                    LineSegmentsArray[i] = new Line[2];
                    // find value in face center as corner values average
                    double centerValue = 0;
                    for (int j = 0; j < 4; j++)
                        centerValue += normVValues[ind[j]];

                    centerValue *= 0.25;
                    int centercase = Convert.ToInt32(centerValue > iso);

                    Point3d a, b, c, d;
                    a = LerpPoint(M.Vertices[ind[0]], M.Vertices[ind[1]], normVValues[ind[0]], normVValues[ind[1]], iso);
                    b = LerpPoint(M.Vertices[ind[1]], M.Vertices[ind[2]], normVValues[ind[1]], normVValues[ind[2]], iso);
                    c = LerpPoint(M.Vertices[ind[2]], M.Vertices[ind[3]], normVValues[ind[2]], normVValues[ind[3]], iso);
                    d = LerpPoint(M.Vertices[ind[3]], M.Vertices[ind[0]], normVValues[ind[3]], normVValues[ind[0]], iso);

                    if ((caseIndex == 5 && centercase == 1) || (caseIndex == 10 && centercase == 0))
                    {
                        // connect edges 0-3, 1-2
                        LineSegmentsArray[i][0] = new Line(a, d);
                        LineSegmentsArray[i][1] = new Line(b, c);
                    }
                    else
                    {
                        // connect edges 0-1, 2-3
                        LineSegmentsArray[i][0] = new Line(a, b);
                        LineSegmentsArray[i][1] = new Line(c, d);
                    }
                }
                // otherwise (only one line to add)
                else
                {
                    int[] edgeIndexes = cases[caseIndex - 1];
                    Point3d[] lineEnds = new Point3d[2];
                    int indA, indB;
                    for (int j = 0; j < 2; j++)
                    {
                        indA = ind[edgeIndexes[j]];
                        indB = ind[(edgeIndexes[j] + 1) % 4];
                        lineEnds[j] = LerpPoint(M.Vertices[indA], M.Vertices[indB], normVValues[indA], normVValues[indB], iso);
                    }

                    LineSegmentsArray[i] = new Line[1];
                    LineSegmentsArray[i][0] = new Line(lineEnds[0], lineEnds[1]);
                }
            }

        });
        return LineSegmentsArray;
    }

    Point3d LerpPoint(Point3d a, Point3d b, double t)
    {
        return a + (b - a) * t;
    }

    Point3d LerpPoint(Point3d a, Point3d b, double va, double vb, double x)
    {
        double t = (x - va) / (vb - va);
        return LerpPoint(a, b, t);
    }


    List<GH_Line> ToLineList(Line[][] LineJaggedArray)
    {
        List<GH_Line> lines = new List<GH_Line>();
        for (int i = 0; i < LineJaggedArray.Length; i++)
            if (LineJaggedArray[i] != null)
                for (int j = 0; j < LineJaggedArray[i].Length; j++)
                    lines.Add(new GH_Line(LineJaggedArray[i][j]));
        return lines;
    }
# ---------- end f_miso ----------

# ----
ftsv2 = FileToScriptV2(File=path)
previewlw = CustomPreviewLineweights(Geometry=f_miso, Shader=ColourSwatch(SwatchColor=RGB(0, 255, 255)), Thickness=Slider(2, range=0..3), Absolute=False)
