# Grasshopper definition mesh loft from polylines update 20200706.gh (Grasshopper 1.0.7)
# Copyright: Co-de-iT

# <title>
# 
# <description>
# 
# code by Alessio Erioli
# 
# v 0.1
# © Co-de-iT 2020 / Creative Commons Attribution-Non Commercial-ShareAlike 4.0 International License
f_pmloft = PolylineMeshLoft()  # -> M; inputs P: tree of Polyline, C: list of Boolean
# ---------- f_pmloft: C# usings ----------
using System.Threading.Tasks;
# ---------- f_pmloft: C# ----------
                                                                       /*
    froGH - a sparse collection of (in)utilities for Grasshopper

    Mesh loft from Polylines with same number of points

    code by Alessio Erioli

    froGH by Co-de-iT is licensed under a Creative Commons Attribution 4.0 International License.
    http://creativecommons.org/licenses/by/4.0/

    */

    initComp();

    if (P.BranchCount == 0 || P == null) return;
    if (C == null || C.Count == 0)
    {
      C = new List<bool>();
      C.Add(false);
    }
    Mesh[] meshes = new Mesh[P.BranchCount];

    // generate bool array
    bool[] closedLoft = new bool[P.BranchCount];
    int boolCount = 0;
    for(int i = 0; i < P.BranchCount; i++)
    {
      closedLoft[i] = C[boolCount];
      if (boolCount < C.Count - 1) boolCount++;
    }


    if (P.BranchCount < 1000)
    {
      // sequential loop

      Mesh m1, m0;
      for(int k = 0; k < P.BranchCount; k++)
      {
        // continue if there aren't enough polylines for loft
        // 2 for open loft, 3 for closed loft
        int closed = closedLoft[k] ? 1 : 0;
        if ( P.Branches[k].Count - closed < 2) continue;

        if (closedLoft[k])
        {
          // closed loft
          m0 = new Mesh();
          int pCount,vCount;
          Point3d[] pts0, pts1;
          pCount = P.Branches[k].Count;
          for (int i = 0; i < P.Branches[k].Count; i++){
            pts0 = P.Branches[k][i % pCount].ToArray();
            pts1 = P.Branches[k][(i + 1) % pCount].ToArray();
            vCount = pts0.Length - 1;
            for (int j = 0; j < vCount; j++){
              m1 = new Mesh();
              m1.Vertices.Add(pts0[j]);
              m1.Vertices.Add(pts0[j + 1]);
              m1.Vertices.Add(pts1[j + 1]);
              m1.Vertices.Add(pts1[j]);
              m1.Faces.AddFace(0, 1, 2, 3);
              m0.Append(m1);
            }
          }
        }else
        {
          // open loft
          m0 = new Mesh();
          int vCount;
          Point3d[] pts0, pts1;
          for (int i = 0; i < P.Branches[k].Count - 1; i++){
            pts0 = P.Branches[k][i].ToArray();
            pts1 = P.Branches[k][i + 1].ToArray();
            vCount = pts0.Length - 1;
            for (int j = 0; j < vCount; j++){
              m1 = new Mesh();
              m1.Vertices.Add(pts0[j]);
              m1.Vertices.Add(pts0[j + 1]);
              m1.Vertices.Add(pts1[j + 1]);
              m1.Vertices.Add(pts1[j]);
              m1.Faces.AddFace(0, 1, 2, 3);
              m0.Append(m1);
            }
          }

        }

        m0.Weld(Math.PI * 0.5);
        m0.Normals.ComputeNormals();
        meshes[k] = m0;
      }

    }
    else
    {
      // go parallel
      Parallel.For(0, P.BranchCount, k =>
        //for(int k = 0; k < P.BranchCount; k++)
        {
        Mesh m1, m0;
        // continue if there aren't enough polylines for loft
        // 2 for open loft, 3 for closed loft
        int closed = closedLoft[k] ? 1 : 0;
        if ( P.Branches[k].Count - closed >= 2){

          if (closedLoft[k])
          {
            // closed loft
            m0 = new Mesh();
            int pCount,vCount;
            Point3d[] pts0, pts1;
            pCount = P.Branches[k].Count;
            for (int i = 0; i < P.Branches[k].Count; i++){
              pts0 = P.Branches[k][i % pCount].ToArray();
              pts1 = P.Branches[k][(i + 1) % pCount].ToArray();
              vCount = pts0.Length - 1;
              for (int j = 0; j < vCount; j++){
                m1 = new Mesh();
                m1.Vertices.Add(pts0[j]);
                m1.Vertices.Add(pts0[j + 1]);
                m1.Vertices.Add(pts1[j + 1]);
                m1.Vertices.Add(pts1[j]);
                m1.Faces.AddFace(0, 1, 2, 3);
                m0.Append(m1);
              }
            }
          }else
          {
            // open loft
            m0 = new Mesh();
            int vCount;
            Point3d[] pts0, pts1;
            for (int i = 0; i < P.Branches[k].Count - 1; i++){
              pts0 = P.Branches[k][i].ToArray();
              pts1 = P.Branches[k][i + 1].ToArray();
              vCount = pts0.Length - 1;
              for (int j = 0; j < vCount; j++){
                m1 = new Mesh();
                m1.Vertices.Add(pts0[j]);
                m1.Vertices.Add(pts0[j + 1]);
                m1.Vertices.Add(pts1[j + 1]);
                m1.Vertices.Add(pts1[j]);
                m1.Faces.AddFace(0, 1, 2, 3);
                m0.Append(m1);
              }
            }

          }

          m0.Weld(Math.PI * 0.5);
          m0.Normals.ComputeNormals();
          meshes[k] = m0;
        }
        });
    }

    M = meshes;
# ---------- f_pmloft: C# additional code ----------
  void initComp(){
    Component.Name = "Polyline Mesh Loft";
    Component.NickName = "f_PMLoft";
    Component.Description = "Lofts  polylines with the same number of vertices into a mesh";
    Component.Params.Input[0].Name = "Polylines";
    Component.Params.Input[0].Description = "Lists of polylines to interpolate as mesh loft";
    Component.Params.Input[1].Name = "Closed";
    Component.Params.Input[1].Description = "True for closed loft, False for open loft";
    Component.Params.Output[0].Name = "Mesh";
    Component.Params.Output[0].Description = "Mesh Loft";
  }
# ---------- end f_pmloft ----------
